# Dynamo graph Create Standard Worksets_script.dyn (Dynamo 2.16.2.5624)

code_block = CodeBlock()
# ---------- code_block.designscript (8 lines) ----------
["Links - Point Cloud",
"Links - Revit",
"Links - DWG, DXF",
"Links - Coordination Model",
"Pipe - Mechanical",
"Pipe - Plumbing",
"Pipe - Underground",
"Sheet Metal"];
# ----------------------------------------
python_script = Python(IN[0]=code_block)  # CPython3
# ---------- python_script.python (67 lines) ----------
# Copyright(c) 2015, Konrad K Sobon
# @arch_laboratory, http://archi-lab.net

import clr

# Import Element wrapper extension methods
clr.AddReference("RevitNodes")
import Revit
clr.ImportExtensions(Revit.Elements)

# Import DocumentManager and TransactionManager
clr.AddReference("RevitServices")
import RevitServices
from RevitServices.Persistence import DocumentManager
from RevitServices.Transactions import TransactionManager

doc = DocumentManager.Instance.CurrentDBDocument

# Import RevitAPI
clr.AddReference("RevitAPI")
import Autodesk
from Autodesk.Revit.DB import *

import sys
pyt_path = r'C:\Program Files (x86)\IronPython 2.7\Lib'
sys.path.append(pyt_path)

#The inputs to this node will be stored as a list in the IN variable.
dataEnteringNode = IN

def ProcessList(_func, _list):
    return map( lambda x: ProcessList(_func, x) if type(x)==list else _func(x), _list )

names = IN[0]

if not isinstance(names, list):
	names = [IN[0]]

def CreateWorkset(name):
	doc = DocumentManager.Instance.CurrentDBDocument
	try:
		w = Workset.Create(doc, name)
	except:
		# if error accurs anywhere in the process catch it
		import traceback
		w = traceback.format_exc()
	return w
	
try:
	errorReport = None
	if not doc.IsWorkshared:
		errorReport = "Worksharing is disabled. How did \nyou expect to make new worksets?"
	else:
		TransactionManager.Instance.EnsureInTransaction(doc)
		newWorksets = ProcessList(CreateWorkset, names)
		TransactionManager.Instance.TransactionTaskDone()

except:
	# if error accurs anywhere in the process catch it
	import traceback
	errorReport = traceback.format_exc()

#Assign your output to the OUT variable
if errorReport == None:
	OUT = newWorksets
else:
	OUT = '\n'.join('{:^35}'.format(s) for s in errorReport.split('\n'))
# ----------------------------------------
