# Dynamo graph View Filters - STRATUS Package Name w Color_script.dyn "View Filters - STRATUS Package Name_script" (Dynamo 2.6.1.8786)
# packages: archi-lab.net 2019.2.1

# group: Get all Piping Elements
code_block = CodeBlock()
# ---------- code_block.designscript (4 lines) ----------
[Category.ByName("Pipes"),
Category.ByName("Pipe Fittings"),
Category.ByName("Pipe Accessories"),
Category.ByName("Plumbing Fixtures")];
# ----------------------------------------
all_elements_of_category = ElementsOfCategory(Category=code_block)

# group: Get Existing Filters and Remove from View
current = Document.Current()
activeView = Document.ActiveView(document=current)
element_types = ElementTypes("FilterElement")
all_elements_of_type = ElementsOfType(element_type=element_types)
name = Element.Name(element=all_elements_of_type)
code_block_2 = CodeBlock { "Package_"; }
contains = String.Contains(str=name, searchFor=code_block_2)
filterByBoolMask = List.FilterByBoolMask(list=all_elements_of_type, mask=contains)
removeFilter = archilab.Revit.Views.Views.RemoveFilter(view=activeView, viewFilter=filterByBoolMask.in)

# group: QTC Package Name Filters
package_filters_false_to_remove = BoolSelector(true)  # graph input

current_2 = Document.Current()
activeView_2 = Document.ActiveView(document=current_2)
all_elements_of_category_in_view = ElementsOfCategoryInView(Category=code_block, View=activeView_2)

# group: Get BOM#
code_block_3 = CodeBlock { "STRATUS Package Name"; }
getParameterValueByName = Element.GetParameterValueByName(element=all_elements_of_category_in_view, parameterName=code_block_3)

# group: Group and Sort
code_block_4 = CodeBlock(list=all_elements_of_category_in_view, list2=getParameterValueByName) { List.Flatten(list,1); List.Flatten(list2,1); }
groupByKey = List.GroupByKey(list=code_block_4.out0, keys=code_block_4.out1)
string_from_object = FromObject(obj=groupByKey.unique_keys)
sort = List.Sort(list=string_from_object)

# group: Create Names
code_block_5 = CodeBlock { "Blank"; ""; }
eq = _ == code_block_5.out1  # unwired: x
replaceByCondition = Replace(item=sort, replaceWith=code_block_5.out0, condition=eq)
code_block_6 = CodeBlock(b=replaceByCondition) { Out="Package_"+b; }

count = List.Count(list=sort)

# group: Filter Parameter
code_block_7 = CodeBlock { Category.ByName("Pipes"); "STRATUS Package Name"; }
all_elements_of_category_2 = ElementsOfCategory(Category=code_block_7.out0)
code_block_8 = CodeBlock(In=code_block_4.out0) { In[0]; }
parameterByName = Parameter.ParameterByName(element=code_block_8, name=code_block_7.out1)
ofRepeatedItem = List.OfRepeatedItem(item=parameterByName, amount=count)

# group: Filter Categories
code_block_9 = CodeBlock(amount=count)
# ---------- code_block_9.designscript (4 lines) ----------
List.OfRepeatedItem([Category.ByName("Pipes"),
Category.ByName("Pipe Fittings"),
Category.ByName("Pipe Accessories"),
Category.ByName("Plumbing Fixtures")],amount);
# ----------------------------------------

# group: Filter Rule
code_block_10 = CodeBlock(x=count) { List.OfRepeatedItem("Equals",x); }
byRuleType = Revit.Filter.FilterRule.ByRuleType(type=code_block_10, value=sort, parameter=ofRepeatedItem, lacing=Longest)

# group: Create Filter
byRules = Revit.Filter.ParameterFilterElement.ByRules(name=code_block_6, categories=code_block_9, rules=byRuleType, lacing=Longest)

# group: Collect Filters to Add (If True) and Sort
list_create = List.Create(item0=byRules, item1=filterByBoolMask.in)
code_block_11 = CodeBlock { "dummy"; 1; "null"; }
if_ = If(test=package_filters_false_to_remove, true=list_create, false=code_block_11.out0)
flatten = List.Flatten(list=if_, amt=code_block_11.out1)
string_from_object_2 = FromObject(obj=flatten)
allIndicesOf = List.AllIndicesOf(list=string_from_object_2, item=code_block_11.out2)
removeItemAtIndex = List.RemoveItemAtIndex(list=flatten, indices=allIndicesOf)
name_2 = Element.Name(element=removeItemAtIndex)
sortByKey = List.SortByKey(list=removeItemAtIndex, keys=name_2)

# group: Add Filters to View
addFilter = View.AddFilter(view=removeFilter, parameterFilter=sortByKey.sorted_list)

# group: Separate 'Blank' filter from numbered
code_block_12 = CodeBlock { "Package_Blank"; }
contains_2 = String.Contains(str=sortByKey.sorted_keys, searchFor=code_block_12)
filterByBoolMask_2 = List.FilterByBoolMask(list=sortByKey.sorted_list, mask=contains_2)

# group: Get Color List
color_list = CodeBlock()
# ---------- color_list.designscript (11 lines) ----------
[Color.ByARGB(255, 220, 20, 60),
Color.ByARGB(255, 0, 0, 255),
Color.ByARGB(255, 127, 255, 0),
Color.ByARGB(255, 255, 0, 255),
Color.ByARGB(255, 0, 255, 255),
Color.ByARGB(255, 255, 140, 0),
Color.ByARGB(255, 148, 0, 211),
Color.ByARGB(255, 0, 0, 128),
Color.ByARGB(255, 240, 128, 128),
Color.ByARGB(255, 0, 100, 0),
Color.ByARGB(255, 70, 130, 180)];
# ----------------------------------------
code_block_13 = CodeBlock(list=addFilter) { x=List.Count(list)-1; Math.Ceiling((x)/11); }
cycle = List.Cycle(list=color_list, amount=code_block_13.out1)
takeItems = List.TakeItems(list=cycle, amount=code_block_13.x)

color_palette = ColorPalette({R: 0, G: 0, B: 0, A: 255})
fill_patterns = FillPatterns("<Solid fill>")

# group: Apply Overrides
firstItem = List.FirstItem(list=addFilter)
byProperties = Revit.Filter.OverrideGraphicSettings.ByProperties(projectionFillColor=takeItems, cutLineColor=color_palette, projectionLineColor=color_palette, projectionFillPattern=fill_patterns)
boolean = BoolSelector(true)
setFilterOverrides = View.SetFilterOverrides(view=firstItem, parameterFilter=filterByBoolMask_2.out, overrides=byProperties, hide=boolean)

color_palette_2 = ColorPalette({R: 169, G: 169, B: 169, A: 255})
color_palette_3 = ColorPalette({R: 0, G: 0, B: 0, A: 255})
fill_patterns_2 = FillPatterns("<Solid fill>")
number = DoubleInput(40)

# group: Apply Overrides to 'Blank' Filter
firstItem_2 = List.FirstItem(list=addFilter)
byProperties_2 = Revit.Filter.OverrideGraphicSettings.ByProperties(projectionFillColor=color_palette_2, cutLineColor=color_palette_3, projectionLineColor=color_palette_3, projectionFillPattern=fill_patterns_2, transparency=number)
boolean_2 = BoolSelector(true)
setFilterOverrides_2 = View.SetFilterOverrides(view=firstItem_2, parameterFilter=filterByBoolMask_2.in, overrides=byProperties_2, hide=boolean_2)
