# Dynamo graph Remove Auto-Filters_script.dyn (Dynamo 2.10.1.3976)
# packages: archi-lab.net 2019.2.1

# group: Get Existing Filters and Remove from View
current = Document.Current()
activeView = Document.ActiveView(document=current)
element_types = ElementTypes("FilterElement")
all_elements_of_type = ElementsOfType(element_type=element_types)
name = Element.Name(element=all_elements_of_type)
code_block = CodeBlock { "Assembly_"; "Package_"; "System_"; "System Color_"; "Specification_"; }
contains = String.Contains(str=name, searchFor=code_block.out0)

contains_2 = String.Contains(str=name, searchFor=code_block.out1)
contains_3 = String.Contains(str=name, searchFor=code_block.out2)
contains_4 = String.Contains(str=name, searchFor=code_block.out3)
contains_5 = String.Contains(str=name, searchFor=code_block.out4)
code_block_2 = CodeBlock(a=contains, b=contains_2, c=contains_3, d=contains_4, e=contains_5) { a||b||c||d||e; }

# group (continued): Get Existing Filters and Remove from View
filterByBoolMask = List.FilterByBoolMask(list=all_elements_of_type, mask=code_block_2)
removeFilter = archilab.Revit.Views.Views.RemoveFilter(view=activeView, viewFilter=filterByBoolMask.in)
