# Dynamo graph HighlightSkewedPipes_script.dyn (Dynamo 2.6.1.8786)

# group: Gets all Pipes in View
categories = Categories("OST_PipeCurves")
current = Document.Current()
activeView = Document.ActiveView(document=current)
all_elements_of_category_in_view = ElementsOfCategoryInView(Category=categories, View=activeView)

# group: Get the vector of pipe geometry
code_block = CodeBlock(pipes=all_elements_of_category_in_view) { lines = Elements.View3D.GetLocation(pipes); waitfor; }  # unwired: waitfor
direction = Line.Direction(line=code_block.lines)

X = Vector.X(vector=direction)
Y = Vector.Y(vector=direction)

# group: Find vectors where X or Y component is zero
code_block_2 = CodeBlock(vecX=X, vecY=Y) { vecX==0; vecY==0; }
xor = Math.Xor(a=code_block_2.out0, b=code_block_2.out1)

# group: Find vectors where X and Y components a equal (45 degrees)
eq = X == Y
xor_2 = Math.Xor(a=xor, b=eq)

# group: Filter out pipes that don't meet the straight or 45 criteria and color
filterByBoolMask = List.FilterByBoolMask(list=all_elements_of_category_in_view, mask=xor_2)
color_palette = ColorPalette({R: 255, G: 69, B: 0, A: 255})
overrideColorInView = Element.OverrideColorInView(element=filterByBoolMask.out, color=color_palette)
