# Dynamo graph Hanger - Update Elevation_script.dyn (Dynamo 2.10.1.3976)
# packages: bimorphNodes 5.1.3

# group: All Pipe Accessories
categories = Categories("OST_PipeAccessory")
current = Document.Current()
activeView = Document.ActiveView(document=current)
all_elements_of_category_in_view = ElementsOfCategoryInView(Category=categories, View=activeView)

# group: Filter down to hangers with the 4 shared parameters used
code_block = CodeBlock(list=all_elements_of_category_in_view)
# ---------- code_block.designscript (5 lines) ----------
ins=Revit.Elements.Element.GetParameterValueByName(list,"QTC Insulation Thickness");
psize=Revit.Elements.Element.GetParameterValueByName(list,"QTC Pipe Size");
bop=Revit.Elements.Element.GetParameterValueByName(list,"BOP");
boi=Revit.Elements.Element.GetParameterValueByName(list,"BOI");
test = ins>=0 && psize>=0 && bop>=0 && boi>=0;
# ----------------------------------------
code_block_2 = CodeBlock { false; }
isNull = Object.IsNull()  # unwired: object
replaceByCondition = Replace(item=code_block.test, replaceWith=code_block_2, condition=isNull)
filterByBoolMask = List.FilterByBoolMask(list=all_elements_of_category_in_view, mask=replaceByCondition)

# group: Create Hanger interferance solid
getLocation = Element.GetLocation(element=filterByBoolMask.in)
code_block_3 = CodeBlock { "Diameter"; }
getParameterValueByName = Element.GetParameterValueByName(element=filterByBoolMask.in, parameterName=code_block_3)
code_block_4 = CodeBlock(dia=getParameterValueByName) { rad = (dia+1.5) /(2*12); }
byCenterPointRadius = Sphere.ByCenterPointRadius(centerPoint=getLocation, radius=code_block_4)

# group: Get all pipes in view
categories_2 = Categories("OST_PipeCurves")
current_2 = Document.Current()
activeView_2 = Document.ActiveView(document=current_2)
all_elements_of_category_in_view_2 = ElementsOfCategoryInView(Category=categories_2, View=activeView_2)

intersectsSolid = Revit.Element.IntersectsSolid(solids=byCenterPointRadius, elements=all_elements_of_category_in_view_2)
intersectingElements = Results.SolidIntersectionResult.IntersectingElements(solidIntersectionResult=intersectsSolid)

# group: Get intersecting pipe
firstItem = List.FirstItem(list=intersectingElements@L2)

code_block_5 = CodeBlock(hanger=filterByBoolMask.in, pipe=firstItem)
# ---------- code_block_5.designscript (43 lines) ----------
hanger;
//Find location of the low end of the pipe
loc=Revit.Elements.Element.GetLocation(pipe);
start=Autodesk.DesignScript.Geometry.Curve.StartPoint(loc);
startz=Autodesk.DesignScript.Geometry.Point.Z(start);
end=Autodesk.DesignScript.Geometry.Curve.EndPoint(loc);
endz=Autodesk.DesignScript.Geometry.Point.Z(end);
lowend=startz<endz?start:end;
//Set elevation of point to 0
lowendx=Autodesk.DesignScript.Geometry.Point.X(lowend);
lowendy=Autodesk.DesignScript.Geometry.Point.Y(lowend);
pipeloc=Autodesk.DesignScript.Geometry.Point.ByCoordinates(lowendx,lowendy,0);
//Get pipe slope
slope=Revit.Elements.Element.GetParameterValueByName(pipe,"Slope");
//Get pipe Bottom Elevation
pbottom=Revit.Elements.Element.GetParameterValueByName(pipe,"Bottom Elevation");

//Get location of hanger
hloc=Revit.Elements.Element.GetLocation(hanger);
//Set elevation of point to 0
locx=Autodesk.DesignScript.Geometry.Point.X(hloc);
locy=Autodesk.DesignScript.Geometry.Point.Y(hloc);
hangloc=Autodesk.DesignScript.Geometry.Point.ByCoordinates(locx,locy,0);
//Get distance from pipe start to hanger location
dist=Autodesk.DesignScript.Geometry.DistanceTo(hangloc,pipeloc);
//Find BOP at hanger location
BOP=(slope*dist)/12+pbottom;
//Find center of Pipe at hanger location
OD = Revit.Elements.Element.GetParameterValueByName(pipe,"Outside Diameter");
CL=BOP+OD/2/12;
//Round to 1/2"
bottomrnd = DSCore.Math.Round(BOP*(12*2))/(12*2);

//Get System Abbreviation
abb=Revit.Elements.Element.GetParameterValueByName(pipe,"System Abbreviation");
//Get Pipe Size
pSize=Revit.Elements.Element.GetParameterValueByName(pipe,"Diameter");
//Get Insulation Thickness
pIns=Revit.Elements.Element.GetParameterValueByName(pipe,"Insulation Thickness");
boi=bottomrnd-(pIns/12);
Pid=Revit.Elements.Element.Id(pipe);
Hsizerough=pSize+2*pIns-0.0625;
rodDia=pSize<=4?0.375:pSize<=8?0.5:pSize<=16?0.625:pSize<=20?0.75:1;
# ----------------------------------------
watch = Watch(code_block_5.hanger)
count = List.Count(list=intersectingElements@L2)
code_block_6 = CodeBlock(ints=count) { multipipe = ints > 1; nopipe = ints < 1; multipipe||nopipe; }
filterByBoolMask_2 = List.FilterByBoolMask(list=filterByBoolMask.in, mask=code_block_6.nopipe)
code_block_7 = CodeBlock(element=filterByBoolMask_2.in) { name=Revit.Elements.Element.Name(element); id=Revit.Elements.Element.Id(element); name+" - " +id; }
hangers_intersecting_no_pipes = Watch(code_block_7.out2)  # graph output
filterByBoolMask_3 = List.FilterByBoolMask(list=filterByBoolMask.in, mask=code_block_6.multipipe)
code_block_8 = CodeBlock(element=filterByBoolMask_3.in) { name=Revit.Elements.Element.Name(element); id=Revit.Elements.Element.Id(element); name+" - " +id; }
hangers_intersecting_multiple = Watch(code_block_8.out2)  # "Hangers Intersecting Multiple Pipes"; graph output
code_block_9 = CodeBlock(hangers=code_block_5.hanger, bottoms=code_block_5.CL, abbs=code_block_5.bottomrnd, pSize=code_block_5.abb, pIns=code_block_5.pSize, boi=code_block_5.pIns, CL=code_block_5.CL) { tag="H-"+[1..List.Count(hangers)]; bottoms; abbs; pSize/12; pIns/12; boi; CL; }
code_block_10 = CodeBlock { 1; }
flatten = List.Flatten(list=code_block_9.tag, amt=code_block_10)
filterByBoolMask_4 = List.FilterByBoolMask(list=filterByBoolMask.in, mask=code_block_6.out2)
count_2 = List.Count(list=filterByBoolMask_4.in)
code_block_11 = CodeBlock(cnt=count_2) { cnt>0; }
all_elements_in_active_view = ElementsInView()
code_block_12 = CodeBlock(test=code_block_11, TrueList=all_elements_in_active_view) { indx = test ? 0 : 1; valueSet = [ TrueList, "Empty" ] [ indx ]; }

# group: View Overrides
color_palette = ColorPalette({R: 192, G: 192, B: 192, A: 255})
fill_patterns = FillPatterns()  # nothing selected
code_block_13 = CodeBlock { 50; }
byProperties = Revit.Filter.OverrideGraphicSettings.ByProperties(cutFillColor=color_palette, projectionFillColor=color_palette, cutLineColor=color_palette, projectionLineColor=color_palette, cutFillPattern=fill_patterns, projectionFillPattern=fill_patterns, transparency=code_block_13)

overrideInView = Element.OverrideInView(element=code_block_12.valueSet, overrides=byProperties)
code_block_14 = CodeBlock(waitfor=overrideInView, pass=filterByBoolMask_4.in) { waitfor; pass; }
color_palette_2 = ColorPalette({R: 255, G: 69, B: 0, A: 255})
overrideColorInView = Element.OverrideColorInView(element=code_block_14.pass, color=color_palette_2)
code_block_15 = CodeBlock { "Mark"; "BOP"; "Comments"; "QTC Pipe Size"; "QTC Insulation Thickness"; "BOI"; "Elevation from Level"; }
setParameterByName = Element.SetParameterByName(element=code_block_5.hanger, parameterName=code_block_15.out6, value=code_block_9.CL)
watch_2 = Watch(code_block_5.CL)
watch_3 = Watch(code_block_5.OD)
watch_4 = Watch(code_block_5.BOP)
