# Dynamo graph Highlight Assemblies for Package_script.dyn (Dynamo 2.6.1.8786)
# packages: archi-lab.net 2019.2.1

# group: Get Existing Filters and Remove from View
current = Document.Current()
activeView = Document.ActiveView(document=current)
element_types = ElementTypes("FilterElement")
all_elements_of_type = ElementsOfType(element_type=element_types)
name = Element.Name(element=all_elements_of_type)
code_block = CodeBlock { "Assembly_"; }
contains = String.Contains(str=name, searchFor=code_block)
filterByBoolMask = List.FilterByBoolMask(list=all_elements_of_type, mask=contains)
removeFilter = archilab.Revit.Views.Views.RemoveFilter(view=activeView, viewFilter=filterByBoolMask.in)

code_block_2 = CodeBlock()
# ---------- code_block_2.designscript (4 lines) ----------
[Category.ByName("Pipes"),
Category.ByName("Pipe Fittings"),
Category.ByName("Pipe Accessories"),
Category.ByName("Plumbing Fixtures")];
# ----------------------------------------
current_2 = Document.Current()
activeView_2 = Document.ActiveView(document=current_2)
all_elements_of_category_in_view = ElementsOfCategoryInView(Category=code_block_2, View=activeView_2)

# group: Get BOM#
code_block_3 = CodeBlock { "Spool Tag"; }
getParameterValueByName = Element.GetParameterValueByName(element=all_elements_of_category_in_view, parameterName=code_block_3)

# group: Group and Sort
code_block_4 = CodeBlock(list=getParameterValueByName, list2=getParameterValueByName) { List.Flatten(list,1); List.Flatten(list2,1); }
groupByKey = List.GroupByKey(list=code_block_4.out0, keys=code_block_4.out1)
string_from_object = FromObject(obj=groupByKey.unique_keys)
sort = List.Sort(list=string_from_object)

# group: Create Names
code_block_5 = CodeBlock { "Blank"; ""; }
eq = _ == code_block_5.out1  # unwired: x
replaceByCondition = Replace(item=sort, replaceWith=code_block_5.out0, condition=eq)
code_block_6 = CodeBlock(b=replaceByCondition) { Out="Assembly_"+b; }

count = List.Count(list=sort)

# group: Filter Categories
code_block_7 = CodeBlock(amount=count)
# ---------- code_block_7.designscript (5 lines) ----------
List.OfRepeatedItem([Category.ByName("Pipes"),
Category.ByName("Pipe Fittings"),
Category.ByName("Pipe Accessories"),
Category.ByName("Plumbing Fixtures"),
Category.ByName("Mechanical Equipment")],amount);
# ----------------------------------------

# group: Filter Parameter
code_block_8 = CodeBlock { Category.ByName("Pipes"); "Spool Tag"; }
all_elements_of_category = ElementsOfCategory(Category=code_block_8.out0)
parameterByName = Parameter.ParameterByName(element=all_elements_of_category, name=code_block_8.out1)
code_block_9 = CodeBlock(In=parameterByName) { In[0]; }
ofRepeatedItem = List.OfRepeatedItem(item=code_block_9, amount=count)

# group: Filter Rule
code_block_10 = CodeBlock(x=count) { List.OfRepeatedItem("Equals",x); }
byRuleType = Revit.Filter.FilterRule.ByRuleType(type=code_block_10, value=sort, parameter=ofRepeatedItem, lacing=Longest)

# group: Create Filter
byRules = Revit.Filter.ParameterFilterElement.ByRules(name=code_block_6, categories=code_block_7, rules=byRuleType, lacing=Longest)

# group: Collect Filters to Add (If True) and Sort
list_create = List.Create(item0=byRules, item1=filterByBoolMask.in)
code_block_11 = CodeBlock { "dummy"; 1; "null"; }
flatten = List.Flatten(list=list_create, amt=code_block_11.out1)
string_from_object_2 = FromObject(obj=flatten)
allIndicesOf = List.AllIndicesOf(list=string_from_object_2, item=code_block_11.out2)
removeItemAtIndex = List.RemoveItemAtIndex(list=flatten, indices=allIndicesOf)
name_2 = Element.Name(element=removeItemAtIndex)
sortByKey = List.SortByKey(list=removeItemAtIndex, keys=name_2)

# group: Add Filters to View
addFilter = View.AddFilter(view=removeFilter, parameterFilter=sortByKey.sorted_list)

# group: Separate 'Blank' filter from numbered
code_block_12 = CodeBlock { "Assembly_Blank"; }
contains_2 = String.Contains(str=sortByKey.sorted_keys, searchFor=code_block_12)
filterByBoolMask_2 = List.FilterByBoolMask(list=sortByKey.sorted_list, mask=contains_2)

# group: Get Color List
of_colors_in_cycle_11max = DoubleInput(11)  # graph input
color_list = CodeBlock()
# ---------- color_list.designscript (11 lines) ----------
[Color.ByARGB(255, 220, 20, 60),
Color.ByARGB(255, 0, 0, 255),
Color.ByARGB(255, 127, 255, 0),
Color.ByARGB(255, 255, 0, 255),
Color.ByARGB(255, 0, 255, 255),
Color.ByARGB(255, 255, 140, 0),
Color.ByARGB(255, 148, 0, 211),
Color.ByARGB(255, 0, 0, 128),
Color.ByARGB(255, 240, 128, 128),
Color.ByARGB(255, 0, 100, 0),
Color.ByARGB(255, 70, 130, 180)];
# ----------------------------------------
code_block_13 = CodeBlock(list=addFilter) { x=List.Count(list)-1; Math.Ceiling((x)/11); }
code_block_14 = CodeBlock(number=of_colors_in_cycle_11max, list=color_list, amt=code_block_13.x) { cycle=11-number; dlist=List.DropItems(List.Flatten(list),cycle); List.Cycle(dlist,amt); }
takeItems = List.TakeItems(list=code_block_14.out2, amount=code_block_13.x)

color_palette = ColorPalette({R: 0, G: 0, B: 0, A: 255})
fill_patterns = FillPatterns("<Solid fill>")

# group: Apply Overrides
firstItem = List.FirstItem(list=addFilter)
byProperties = Revit.Filter.OverrideGraphicSettings.ByProperties(projectionFillColor=takeItems, cutLineColor=color_palette, projectionLineColor=color_palette, projectionFillPattern=fill_patterns)
boolean = BoolSelector(true)
setFilterOverrides = View.SetFilterOverrides(view=firstItem, parameterFilter=filterByBoolMask_2.out, overrides=byProperties, hide=boolean)

color_palette_2 = ColorPalette({R: 169, G: 169, B: 169, A: 255})
color_palette_3 = ColorPalette({R: 0, G: 0, B: 0, A: 255})
fill_patterns_2 = FillPatterns("<Solid fill>")

# group: Apply Overrides to 'Blank' Filter
firstItem_2 = List.FirstItem(list=addFilter)
byProperties_2 = Revit.Filter.OverrideGraphicSettings.ByProperties(projectionFillColor=color_palette_2, cutLineColor=color_palette_3, projectionLineColor=color_palette_3, projectionFillPattern=fill_patterns_2)
boolean_2 = BoolSelector(true)
setFilterOverrides_2 = View.SetFilterOverrides(view=firstItem_2, parameterFilter=filterByBoolMask_2.in, overrides=byProperties_2, hide=boolean_2)

number = DoubleInput(40)

# group: Get Existing Filters and Remove from View
current_3 = Document.Current()
activeView_3 = Document.ActiveView(document=current_3)
element_types_2 = ElementTypes("FilterElement")
all_elements_of_type_2 = ElementsOfType(element_type=element_types_2)
name_3 = Element.Name(element=all_elements_of_type_2)
code_block_15 = CodeBlock { "Package_"; }
contains_3 = String.Contains(str=name_3, searchFor=code_block_15)
filterByBoolMask_3 = List.FilterByBoolMask(list=all_elements_of_type_2, mask=contains_3)
removeFilter_2 = archilab.Revit.Views.Views.RemoveFilter(view=activeView_3, viewFilter=filterByBoolMask_3.in)

# group: Get BOM#
code_block_16 = CodeBlock { "STRATUS Package Name"; }
getParameterValueByName_2 = Element.GetParameterValueByName(element=all_elements_of_category_in_view, parameterName=code_block_16)

# group: Group and Sort
code_block_17 = CodeBlock(list=all_elements_of_category_in_view, list2=getParameterValueByName_2) { List.Flatten(list,1); List.Flatten(list2,1); }
groupByKey_2 = List.GroupByKey(list=code_block_17.out0, keys=code_block_17.out1)
string_from_object_3 = FromObject(obj=groupByKey_2.unique_keys)
sort_2 = List.Sort(list=string_from_object_3)

# group: Create Names
code_block_18 = CodeBlock { "Blank"; ""; }
eq_2 = _ == code_block_18.out1  # unwired: x
replaceByCondition_2 = Replace(item=sort_2, replaceWith=code_block_18.out0, condition=eq_2)
code_block_19 = CodeBlock(b=replaceByCondition_2) { Out="Package_"+b; }

count_2 = List.Count(list=sort_2)

# group: Filter Parameter
code_block_20 = CodeBlock { Category.ByName("Pipes"); "STRATUS Package Name"; }
all_elements_of_category_2 = ElementsOfCategory(Category=code_block_20.out0)
code_block_21 = CodeBlock(In=code_block_17.out0) { In[0]; }
parameterByName_2 = Parameter.ParameterByName(element=code_block_21, name=code_block_20.out1)
ofRepeatedItem_2 = List.OfRepeatedItem(item=parameterByName_2, amount=count_2)

# group: Filter Categories
code_block_22 = CodeBlock(amount=count_2)  # same code as code_block_7

# group: Filter Rule
code_block_23 = CodeBlock(x=count_2) { List.OfRepeatedItem("Equals",x); }
byRuleType_2 = Revit.Filter.FilterRule.ByRuleType(type=code_block_23, value=sort_2, parameter=ofRepeatedItem_2, lacing=Longest)

# group: Create Filter
byRules_2 = Revit.Filter.ParameterFilterElement.ByRules(name=code_block_19, categories=code_block_22, rules=byRuleType_2, lacing=Longest)

# group: Collect Filters to Add (If True) and Sort
list_create_2 = List.Create(item0=byRules_2, item1=filterByBoolMask_3.in)
code_block_24 = CodeBlock { "dummy"; 1; "null"; }
flatten_2 = List.Flatten(list=list_create_2, amt=code_block_24.out1)
string_from_object_4 = FromObject(obj=flatten_2)
allIndicesOf_2 = List.AllIndicesOf(list=string_from_object_4, item=code_block_24.out2)
removeItemAtIndex_2 = List.RemoveItemAtIndex(list=flatten_2, indices=allIndicesOf_2)
name_4 = Element.Name(element=removeItemAtIndex_2)
sortByKey_2 = List.SortByKey(list=removeItemAtIndex_2, keys=name_4)

# group: Add Filters to View
addFilter_2 = View.AddFilter(view=removeFilter_2, parameterFilter=sortByKey_2.sorted_list)

name_5 = Element.Name(element=activeView_2)
length = String.Length(str=name_5)
code_block_25 = CodeBlock(length=length) { 0; length-16; }
substring = String.Substring(str=name_5, startIndex=code_block_25.out0, length=code_block_25.out1)

# group: Separate 'Blank' filter from numbered
contains_4 = String.Contains(str=sortByKey_2.sorted_keys, searchFor=substring)
filterByBoolMask_4 = List.FilterByBoolMask(list=sortByKey_2.sorted_list, mask=contains_4)

color_palette_4 = ColorPalette({R: 169, G: 169, B: 169, A: 255})
color_palette_5 = ColorPalette({R: 169, G: 169, B: 169, A: 255})
fill_patterns_3 = FillPatterns("<Solid fill>")
number_2 = DoubleInput(40)

# group: Apply Overrides to 'Blank' Filter
firstItem_3 = List.FirstItem(list=addFilter_2)
byProperties_3 = Revit.Filter.OverrideGraphicSettings.ByProperties(projectionFillColor=color_palette_4, cutLineColor=color_palette_5, projectionLineColor=color_palette_5, projectionFillPattern=fill_patterns_3, transparency=number_2)
boolean_3 = BoolSelector(true)
setFilterOverrides_3 = View.SetFilterOverrides(view=firstItem_3, parameterFilter=filterByBoolMask_4.out, overrides=byProperties_3, hide=boolean_3)

# group: Get Current Selection
python_script = Python()  # unwired: IN[0]
# ---------- python_script.python (21 lines) ----------
#Copyright(c) 2016, Dimitar Venkov
# @5devene, dimitar.ven@gmail.com

import clr

clr.AddReference("RevitNodes")
import Revit
clr.ImportExtensions(Revit.Elements)

clr.AddReference("RevitServices")
import RevitServices
from RevitServices.Persistence import DocumentManager
doc = DocumentManager.Instance.CurrentDBDocument
uidoc = DocumentManager.Instance.CurrentUIApplication.ActiveUIDocument

def output1(l1):
	if len(l1) == 1: return l1[0]
	else: return l1

selid = uidoc.Selection.GetElementIds()
OUT = output1([doc.GetElement(id).ToDSType(True) for id in selid])
# ----------------------------------------

# group: Get BOM#
code_block_26 = CodeBlock { "STRATUS Package Name"; }
getParameterValueByName_3 = Element.GetParameterValueByName(element=python_script, parameterName=code_block_26)
