# Dynamo graph Fit line to Selected Points_script.dyn "Fit line to Selected Points WIP" (Dynamo 2.3.1.11775)

current = Document.Current()
activeView = Document.ActiveView(document=current)

# group: Get Current Selection
python_script = Python()  # unwired: IN[0]
# ---------- python_script.python (21 lines) ----------
#Copyright(c) 2016, Dimitar Venkov
# @5devene, dimitar.ven@gmail.com

import clr

clr.AddReference("RevitNodes")
import Revit
clr.ImportExtensions(Revit.Elements)

clr.AddReference("RevitServices")
import RevitServices
from RevitServices.Persistence import DocumentManager
doc = DocumentManager.Instance.CurrentDBDocument
uidoc = DocumentManager.Instance.CurrentUIApplication.ActiveUIDocument

def output1(l1):
	if len(l1) == 1: return l1[0]
	else: return l1

selid = uidoc.Selection.GetElementIds()
OUT = output1([doc.GetElement(id).ToDSType(True) for id in selid])
# ----------------------------------------
selected_elements = Watch(python_script)

# group: Get Coordinates
code_block = CodeBlock(element=selected_elements) { Elements.View3D.GetLocation(element); }
code_block_2 = CodeBlock { 2; }
flatten = List.Flatten(list=code_block, amt=code_block_2)

byBestFitThroughPoints = Line.ByBestFitThroughPoints(bestFitPoints=flatten)
byCurve = DetailCurve.ByCurve(view=activeView, curve=byBestFitThroughPoints)
