# Dynamo graph Apply Pipe End Conditions 1.2.dyn "Apply Pipe End Conditions 1.2_script" (Dynamo 2.6.1.8786)

# group: Get all pipes in the active view
categories = Categories("OST_PipeCurves")
current = Document.Current()
activeView = Document.ActiveView(document=current)
all_elements_of_category_in_view = ElementsOfCategoryInView(Category=categories, View=activeView)

# group: Get connected elements
mep_connector_info_from_mep_over = Python(IN[0]=all_elements_of_category_in_view)
# ---------- mep_connector_info_from_mep_over.python (73 lines) ----------
import clr
import math

clr.AddReference("RevitServices")
import RevitServices
from RevitServices.Persistence import DocumentManager
from RevitServices.Transactions import TransactionManager
doc = DocumentManager.Instance.CurrentDBDocument

clr.AddReference("RevitAPI")
import Autodesk
from Autodesk.Revit.DB import *

clr.AddReference("RevitNodes")
import Revit
clr.ImportExtensions(Revit.Elements)
clr.ImportExtensions(Revit.GeometryConversion)
#The inputs to this node will be stored as a list in the IN variables.
if isinstance(IN[0], list):
	fittings = UnwrapElement(IN[0])
	toggle = 0
else:
	toggle = 1
	fittings = [UnwrapElement(IN[0])]
	
p = []
dir = []
rep = []
ref = []

for fitting in fittings:
	
	points = []
	direction = []
	report = []
	refs = []
	
	try:
		connectors = fitting.MEPModel.ConnectorManager.Connectors
	except:
		try:
			connectors = fitting.ConnectorManager.Connectors
		except:
			p.append(None)
			dir.append(None)
			rep.append(None)
			ref.append(None)
			continue
	for conn in connectors:
		points.append(conn.Origin.ToPoint())
		direction.append(conn.CoordinateSystem.BasisZ.ToVector())
		result = ""
		try:
			result += "Direction: " + conn.Direction.ToString()
		except:
			result += "Direction: N/A"
		result += ", AllRefs Size: " + conn.AllRefs.Size.ToString()
		result += ", Domain: " + conn.Domain.ToString()
		result += ", Type: " + conn.ConnectorType.ToString()
		report.append(result)
		for c in conn.AllRefs:
			refs.append(c.Owner)
	p.append(points)
	dir.append(direction)
	rep.append(report)
	ref.append(refs)


#Assign your output to the OUT variable.
if toggle:
	OUT = refs
else:
	OUT = ref
# ----------------------------------------

# group: Count Connections
code_block = CodeBlock(list=mep_connector_info_from_mep_over) { Elements.Element.GetParameterValueByName(list,"Family"); "Vic"; "Weld"; "BW"; "FPT"; "THD"; true; "npt"; }
string_from_object = FromObject(obj=code_block.out0)
contains = String.Contains(str=string_from_object, searchFor=code_block.out2, ignoreCase=code_block.out6)
contains_2 = String.Contains(str=string_from_object, searchFor=code_block.out3, ignoreCase=code_block.out6)
code_block_2 = CodeBlock(a=contains, b=contains_2) { a||b; }
countTrue = List.CountTrue(list=code_block_2@L2)
contains_3 = String.Contains(str=string_from_object, searchFor=code_block.out1, ignoreCase=code_block.out6)
countTrue_2 = List.CountTrue(list=contains_3@L2)
contains_4 = String.Contains(str=string_from_object, searchFor=code_block.out4, ignoreCase=code_block.out6)
contains_5 = String.Contains(str=string_from_object, searchFor=code_block.out5, ignoreCase=code_block.out6)
contains_6 = String.Contains(str=string_from_object, searchFor=code_block.out7, ignoreCase=code_block.out6)
code_block_3 = CodeBlock(a=contains_4, b=contains_5, c=contains_6) { a||b||c; }
countTrue_3 = List.CountTrue(list=code_block_3@L2)

code_block_4 = CodeBlock(weld=countTrue, vic=countTrue_2, thd=countTrue_3, list=all_elements_of_category_in_view)
# ---------- code_block_4.designscript (4 lines) ----------
//Connection number logic and apply pipe ends parameter
ends=weld>=2?"BEVxBEV":vic==1&&weld>=1?"GRVxBEV":vic>=2?"GRVxGRV":thd>=2?"THDxTHD"
:thd==1&&weld==1?"THDxBEV":thd==1&&vic==1?"THDxGRV":weld==1?"BEVxBEV":"";
Elements.Element.SetParameterByName(list,"QTC Pipe Ends",ends);
# ----------------------------------------

# group: Get pipes and connected elements with no end conditions
code_block_5 = CodeBlock(list=code_block_4.out1) { Elements.Element.GetParameterValueByName(list,"QTC Pipe Ends")==""; }
filterByBoolMask = List.FilterByBoolMask(list=code_block_4.out1, mask=code_block_5)
mep_connector_info_from_mep_over_2 = Python(IN[0]=filterByBoolMask.in)  # same code as mep_connector_info_from_mep_over

code_block_6 = CodeBlock(list=mep_connector_info_from_mep_over_2) { List.Flatten(list,1); }

# group (continued): Get pipes and connected elements with no end conditions
list_create = List.Create(item0=filterByBoolMask.in, item1=code_block_6)
code_block_7 = CodeBlock(list=list_create) { List.Flatten(list,1); }

# group: Isolate Elements in View
current_2 = Document.Current()
activeView_2 = Document.ActiveView(document=current_2)
isolate_selected_elements = Python(IN[0]=code_block_7, IN[1]=activeView_2)
# ---------- isolate_selected_elements.python (27 lines) ----------
import clr
clr.AddReference('RevitAPI')
from Autodesk.Revit.DB import *
from System.Collections.Generic import *

clr.AddReference("RevitServices")
import RevitServices
from RevitServices.Persistence import DocumentManager
from RevitServices.Transactions import TransactionManager

def TempIsolateElements(view, items):
	if not items: return False
	elif not isinstance(items, list): items = [items]
	ielements = List[ElementId]([x.Id for x in UnwrapElement(items)])
	try:
		UnwrapElement(view).IsolateElementsTemporary(ielements)
		return True
	except: return False

doc = DocumentManager.Instance.CurrentDBDocument

TransactionManager.Instance.EnsureInTransaction(doc)
if isinstance(IN[1], list):
	if isinstance(IN[0], list): OUT = [TempIsolateElements(x, y) for x, y in zip(IN[1], IN[0])]
	else: OUT = [TempIsolateElements(x, IN[0]) for x in IN[1]]
else: OUT = TempIsolateElements(IN[1], IN[0])
TransactionManager.Instance.TransactionTaskDone()
# ----------------------------------------

code_block_8 = CodeBlock(list=mep_connector_info_from_mep_over_2) { Elements.Element.GetParameterValueByName(list,"Family"); }
