# Dynamo graph Insulate From Schedule-noinputs_1.1_script.dyn "Insulate From Schedule-noinputs_script_1.1" (Dynamo 2.16.2.5624)

# group: Get Excel data
code_block = CodeBlock { "Insulation Schedule Path"; }
findByName = GlobalParameter.FindByName(name=code_block)
value = GlobalParameter.Value(globalParameter=findByName)
importCSV = Data.ImportCSV(filePath=value)
code_block_2 = CodeBlock(list=importCSV)
# ---------- code_block_2.designscript (14 lines) ----------
list;
tlist=DSCore.List.Transpose(list);
dlist=DSCore.List.DropItems(tlist,1);
rlist=DSCore.List.Transpose(dlist);









Systems=rlist[0];
# ----------------------------------------

systems_in_list = Watch(code_block_2.Systems)

# group: Pipe and Fittings
code_block_3 = CodeBlock { Category.ByName("Pipe Fittings"); Category.ByName("Pipes"); }
current = Document.Current()
activeView = Document.ActiveView(document=current)
all_elements_of_category_in_view = ElementsOfCategoryInView(Category=code_block_3.out0, View=activeView)
all_elements_of_category_in_view_2 = ElementsOfCategoryInView(Category=code_block_3.out1, View=activeView)

# group: Filter Fittings Down to Elbows
get_fitting_part_type = Python(IN[0]=all_elements_of_category_in_view)  # IronPython2
# ---------- get_fitting_part_type.python (15 lines) ----------
# Load the Python Standard and DesignScript Libraries
import sys
import clr
clr.AddReference('ProtoGeometry')
from Autodesk.DesignScript.Geometry import *

#The inputs to this node will be stored as a list in the IN variables.
fittings = UnwrapElement(IN[0])
listout = []

for x in fittings:
	listout.append(x.MEPModel.PartType)

#Assign your output to the OUT variable.
OUT = listout
# ----------------------------------------
string_from_object = FromObject(object=get_fitting_part_type)
code_block_4 = CodeBlock(ftg=string_from_object) { tee=ftg=="Tee"; elbow=ftg=="Elbow"; wye=ftg=="Wye"; cross=ftg=="Cross"; tee||elbow||wye||cross; }
filterByBoolMask = List.FilterByBoolMask(list=all_elements_of_category_in_view, mask=code_block_4.elbow)

# group: Collect elements
list_create = List.Create(item0=filterByBoolMask.in, item1=all_elements_of_category_in_view_2)
code_block_5 = CodeBlock { 1; }
flatten = List.Flatten(list=list_create, amount=code_block_5)

# group: Filter out pipes whose system abbreviation is not found in the schedule
code_block_6 = CodeBlock { "System Abbreviation"; }
getParameterValueByName = Element.GetParameterValueByName(element=flatten, parameterName=code_block_6)
code_block_7 = CodeBlock(pipes=getParameterValueByName, list=code_block_2.Systems) { pipes; index=DSCore.List.IndexOf(list,pipes); index>=0; "System Abbreviation"; }
filterByBoolMask_2 = List.FilterByBoolMask(list=flatten, mask=code_block_7.out2)

# group: Missing Systems Output
code_block_8 = CodeBlock(out=filterByBoolMask_2.out)
# ---------- code_block_8.designscript (3 lines) ----------
Revit.Elements.Element.
GetParameterValueByName(
out,"System Abbreviation");
# ----------------------------------------
groupByKey = List.GroupByKey(list=code_block_8, keys=code_block_8)
systems_in_project_not_found_in = Watch(groupByKey.uniqueKeys)  # "Systems in Project not found in Insulation Schedule"; graph output

# group: Get Category & System Abbreviation of Passed Elements
code_block_9 = CodeBlock(list=filterByBoolMask_2.in)
# ---------- code_block_9.designscript (5 lines) ----------
Revit.Elements.Element.
GetCategory(list);
Revit.Elements.Element.
GetParameterValueByName(
list,"System Abbreviation");
# ----------------------------------------
string_from_object_2 = FromObject(object=code_block_9.out0)

# group: Replace Null with 0
code_block_10 = CodeBlock { 0; }
isNull = Object.IsNull()  # unwired: object
replaceByCondition = Replace(item=code_block_2.dlist, replaceWith=code_block_10, condition=isNull)

code_block_11 = CodeBlock(categories=string_from_object_2, pipesys=code_block_9.out1, dlist=replaceByCondition, systems=code_block_2.Systems)
# ---------- code_block_11.designscript (13 lines) ----------
categories=="Pipes"?"Diameter":"Diameter1";
pipesys;
dlist;
index=DSCore.List.IndexOf(systems,pipesys);
sizes=dlist[index];
1;
2;
3;
4;
5;
//For each element to be insulated, match it's
//sys abbrev with one from the schecule,
//then find the matching size list from the sched
# ----------------------------------------

# group: Systems Insulation Added Output
groupByKey_2 = List.GroupByKey(list=code_block_11.pipesys, keys=code_block_11.pipesys)
systems_insulation_added = Watch(groupByKey_2.uniqueKeys)  # graph output

# group: Remove Insulation from Elements
python_script = Python(IN[0]=filterByBoolMask_2.in)  # IronPython2
# ---------- python_script.python (33 lines) ----------
import clr

clr.AddReference("RevitServices")
import RevitServices
from RevitServices.Persistence import DocumentManager
from RevitServices.Transactions import TransactionManager
doc = DocumentManager.Instance.CurrentDBDocument

clr.AddReference("RevitAPI")
import Autodesk
from Autodesk.Revit.DB import *

clr.AddReference("RevitNodes")
import Revit
clr.ImportExtensions(Revit.Elements)
clr.ImportExtensions(Revit.GeometryConversion)

if isinstance(IN[0], list):
	pipes = UnwrapElement(IN[0])
else:
	pipes = [UnwrapElement(IN[0])]

listout = []

for pipe in pipes:
	try:
		insulation = InsulationLiningBase.GetInsulationIds(doc,pipe.Id)
		listout.append(doc.GetElement(insulation[0]))
	except:
		listout.append(None)


OUT = listout
# ----------------------------------------
code_block_12 = CodeBlock { false; }
clean = List.Clean(list=python_script, preserveIndices=code_block_12)
delete = Element.Delete(element=clean)

code_block_13 = CodeBlock(wait=delete, pass=filterByBoolMask_2.in) { wait; pass; }

# group: Get insulation type
element_types = ElementTypes("PipeInsulationType")
all_elements_of_type = ElementsOfType(element_class=element_types)
firstItem = List.FirstItem(list=all_elements_of_type)

# group: Get size of pipe/fitting
getParameterValueByName_2 = Element.GetParameterValueByName(element=filterByBoolMask_2.in, parameterName=code_block_11.out0)

# group: Parse Sizes from table
getItemAtIndex = List.GetItemAtIndex(list=code_block_11.sizes@L2, index=code_block_11.out5)
getItemAtIndex_2 = List.GetItemAtIndex(list=code_block_11.sizes@L2, index=code_block_11.out6)
getItemAtIndex_3 = List.GetItemAtIndex(list=code_block_11.sizes@L2, index=code_block_11.out7)
getItemAtIndex_4 = List.GetItemAtIndex(list=code_block_11.sizes@L2, index=code_block_11.out8)
getItemAtIndex_5 = List.GetItemAtIndex(list=code_block_11.sizes@L2, index=code_block_11.out9)

apply_insulation_size_logic = CodeBlock(size=getParameterValueByName_2, inssize1=getItemAtIndex, psize2=getItemAtIndex_2, inssize2=getItemAtIndex_3, psize3=getItemAtIndex_4, inssize3=getItemAtIndex_5)
# ---------- apply_insulation_size_logic.designscript (9 lines) ----------
size;
inssize1;
psize2;
inssize2;
psize3;
inssize3;
size1test=size<psize2||psize2==0;
size3test=size>=(psize3-0.01)&&psize3>0;
inssize=size>0?(size1test?inssize1:size3test?inssize3:inssize2)/12:0;
# ----------------------------------------

# group: Apply insulation
python_script_2 = Python(IN[0]=code_block_13.pass, IN[1]=firstItem, IN[2]=apply_insulation_size_logic.inssize)  # IronPython2
# ---------- python_script_2.python (67 lines) ----------
import clr

clr.AddReference("RevitServices")
import RevitServices
from RevitServices.Persistence import DocumentManager
from RevitServices.Transactions import TransactionManager
doc = DocumentManager.Instance.CurrentDBDocument
uiapp = DocumentManager.Instance.CurrentUIApplication
app = uiapp.Application

clr.AddReference("RevitAPI")
import Autodesk
from Autodesk.Revit.DB import *

clr.AddReference("RevitNodes")
import Revit
clr.ImportExtensions(Revit.Elements)
clr.ImportExtensions(Revit.GeometryConversion)

if isinstance(IN[0], list):
	pipes = UnwrapElement(IN[0])
else:
	pipes = [UnwrapElement(IN[0])]
if isinstance(IN[1], list):
	insultype = UnwrapElement(IN[1])
else:
	insultype = [UnwrapElement(IN[1])]
li = len(insultype)
if isinstance(IN[2], list):
	size = IN[2]
else:
	size = [IN[2]]
ls = len(size)


if int(app.VersionNumber) < 2021:
	dut = doc.GetUnits().GetFormatOptions(UnitType.UT_Length).DisplayUnits
	bool = dut == DisplayUnitType.DUT_MILLIMETERS
	size = map(lambda x:UnitUtils.Convert(x,DisplayUnitType.DUT_MILLIMETERS,DisplayUnitType.DUT_DECIMAL_FEET) if bool else x, size)
else:
	unittype = SpecTypeId.Length
	dut = doc.GetUnits().GetFormatOptions(unittype).GetUnitTypeId()
	bool = dut == UnitTypeId.Millimeters
	size = map(lambda x:UnitUtils.Convert(x,UnitTypeId.Millimeters,UnitTypeId.Feet) if bool else x, size)


failed = []
succes = []

TransactionManager.Instance.EnsureInTransaction(doc)
for i,pipe in enumerate(pipes):
	s = i%ls
	l = i%li
	try:
		Plumbing.PipeInsulation.Create(doc,pipe.Id,insultype[l].Id,size[s])
		succes.append(pipe)
	except:
		try:
			Mechanical.DuctInsulation.Create(doc,pipe.Id,insultype[l].Id,size[s])
			succes.append(pipe)
		except:
			failed.append(pipe)

TransactionManager.Instance.TransactionTaskDone()


OUT = succes, failed
# ----------------------------------------
