# Dynamo graph Place Points over Family 2.7_script.dyn "Place Points over Family 2.7" (Dynamo 2.6.1.8786)

# group: Input Start #
starting_number = DoubleInput(1)  # graph input

get_current_selection = Python()  # unwired: IN[0]
# ---------- get_current_selection.python (21 lines) ----------
#Copyright(c) 2016, Dimitar Venkov
# @5devene, dimitar.ven@gmail.com

import clr

clr.AddReference("RevitNodes")
import Revit
clr.ImportExtensions(Revit.Elements)

clr.AddReference("RevitServices")
import RevitServices
from RevitServices.Persistence import DocumentManager
doc = DocumentManager.Instance.CurrentDBDocument
uidoc = DocumentManager.Instance.CurrentUIApplication.ActiveUIDocument

def output1(l1):
	if len(l1) == 1: return l1[0]
	else: return l1

selid = uidoc.Selection.GetElementIds()
OUT = output1([doc.GetElement(id).ToDSType(True) for id in selid])
# ----------------------------------------

# group: Get all instances of the selected family in current view
getCategory = Element.GetCategory(element=get_current_selection)
current = Document.Current()
activeView = Document.ActiveView(document=current)
all_elements_of_category_in_view = ElementsOfCategoryInView(Category=getCategory, View=activeView)

code_block = CodeBlock(list=all_elements_of_category_in_view, list2=get_current_selection) { Family.Name(list); Family.Name(list2); }

# group (continued): Get all instances of the selected family in current view
string_from_object = FromObject(obj=code_block.out0)
string_from_object_2 = FromObject(obj=code_block.out1)
eq = string_from_object == string_from_object_2  # lacing=Longest
filterByBoolMask = List.FilterByBoolMask(list=all_elements_of_category_in_view, mask=eq)

# group: Get coordinates of all elements
code_block_2 = CodeBlock(element=filterByBoolMask.in) { Elements.View3D.GetLocation(element); }
code_block_3 = CodeBlock { 2; }
flatten = List.Flatten(list=code_block_2, amt=code_block_3)

# group: Round to 1/8" and create key for unique x-y
X = Point.X(point=flatten)
Y = Point.Y(point=flatten)
code_block_4 = CodeBlock(x=X, y=Y) { xr=Math.Round(x*12*8); yr=Math.Round(y*12*8); coordstr=xr+"str"+yr; }

# group: Get one coordinate from each rounded key
groupByKey = List.GroupByKey(list=flatten, keys=code_block_4.coordstr)
firstItem = List.FirstItem(list=groupByKey.groups@L2)
code_block_5 = CodeBlock { 1; }
flatten_2 = List.Flatten(list=firstItem, amt=code_block_5)

# group: Input Point Type to Place
select_family_to_place = FamilyTypes("SSW Layout Point:Control Point")  # graph input

# group: Place points
place_family_instance_by_point = Python(IN[0]=flatten_2, IN[1]=select_family_to_place)  # "Place Family Instance By Point in Transaction"
# ---------- place_family_instance_by_point.python (33 lines) ----------
import clr
clr.AddReference('RevitAPI')
from Autodesk.Revit.DB import *

clr.AddReference("RevitNodes")
import Revit
clr.ImportExtensions(Revit.Elements)
clr.ImportExtensions(Revit.GeometryConversion)

clr.AddReference("RevitServices")
import RevitServices
from RevitServices.Persistence import DocumentManager
from RevitServices.Transactions import TransactionManager
from Autodesk.Revit.DB.Structure import *

doc = DocumentManager.Instance.CurrentDBDocument
points = UnwrapElement(IN[0])
famtype = UnwrapElement(IN[1])

elementlist = list()

ST = StructuralType.NonStructural

TransactionManager.Instance.EnsureInTransaction(doc)
# Make sure the familysymbol is active
if famtype.IsActive == False:
	famtype.Activate()
	doc.Regenerate()
for point in points:
	newobj = doc.Create.NewFamilyInstance(point.ToXyz(),famtype,ST)
	elementlist.append(newobj)
TransactionManager.Instance.TransactionTaskDone()
OUT = elementlist
# ----------------------------------------

# group: Apply Point Number
prefix = StringInput("PT")  # graph input
count = List.Count(list=place_family_instance_by_point)
code_block_6 = CodeBlock(start=starting_number, count=count) { start; count+(start-1); 1; }
range = Range(start=starting_number, end=code_block_6.out1, step=code_block_6.out2)
string_from_object_3 = FromObject(obj=range)
add = prefix + string_from_object_3
code_block_7 = CodeBlock { "Mark"; }
setParameterByName = Element.SetParameterByName(element=place_family_instance_by_point, parameterName=code_block_7, value=add)

# group: Output
lastItem = List.LastItem(list=add)
last_number = Watch(lastItem)  # graph output

# group: Input Layer
layer = StringInput("0")  # graph input

# group: Apply Layer Name
code_block_8 = CodeBlock { "Comments"; }
setParameterByName_2 = Element.SetParameterByName(element=setParameterByName, parameterName=code_block_8, value=layer)

# group: Output
count_2 = List.Count(list=setParameterByName_2)
points_placed = Watch(count_2)  # graph output

# group: Note Output
code_block_9 = CodeBlock { "Uses current selection as the family to place points over"; }
note = Watch(code_block_9)  # graph output
