# Dynamo graph Tag Assemblies_script.dyn "Tag Assemblies" (Dynamo 2.6.1.8786)
# packages: Genius Loci 2023.7.13

# group: Active View
current = Document.Current()
activeView = Document.ActiveView(document=current)

lock_view = Python(IN[0]=activeView)
# ---------- lock_view.python (42 lines) ----------
# © 2020 Fabio de Agostini

import clr
# references
clr.AddReference("RevitAPI")
clr.AddReference("RevitAPIUI")
clr.AddReference("RevitNodes")
clr.AddReference("RevitServices")
import Revit
import RevitServices
from Autodesk.Revit.DB import *
from RevitServices.Persistence import DocumentManager
from RevitServices.Transactions import TransactionManager
clr.ImportExtensions(Revit.GeometryConversion)

# definitions
def me_in(input):
    if hasattr( input , '__iter__' ):
        return input
    else: return [ input ]

def me_out(output):
    if len(output) == 1:
        return output[0]
    else: return output

# inputs
view = [UnwrapElement(e) for e in me_in(IN[0])]

# data
doc = DocumentManager.Instance.CurrentDBDocument
result = []

# main code here
TransactionManager.Instance.EnsureInTransaction(doc)
for v in view:
	v.SaveOrientationAndLock()
	result.append(v)
TransactionManager.Instance.TransactionTaskDone()

# end
OUT = me_out(result)
# ----------------------------------------
code_block = CodeBlock(wait=lock_view, pass=activeView) { wait; pass; }

# group: Get Package Name of Current Selection
code_block_2 = CodeBlock { "STRATUS Package Name"; }
current_selection = Python()  # unwired: IN[0]
# ---------- current_selection.python (21 lines) ----------
#Copyright(c) 2016, Dimitar Venkov
# @5devene, dimitar.ven@gmail.com

import clr

clr.AddReference("RevitNodes")
import Revit
clr.ImportExtensions(Revit.Elements)

clr.AddReference("RevitServices")
import RevitServices
from RevitServices.Persistence import DocumentManager
doc = DocumentManager.Instance.CurrentDBDocument
uidoc = DocumentManager.Instance.CurrentUIApplication.ActiveUIDocument

def output1(l1):
	if len(l1) == 1: return l1[0]
	else: return l1

selid = uidoc.Selection.GetElementIds()
OUT = output1([doc.GetElement(id).ToDSType(True) for id in selid])
# ----------------------------------------
getParameterValueByName = Element.GetParameterValueByName(element=current_selection, parameterName=code_block_2)

# group: Get elements in View that Match the Package of Current Selection
all_elements_in_active_view = ElementsInView()
getParameterValueByName_2 = Element.GetParameterValueByName(element=all_elements_in_active_view, parameterName=code_block_2)
eq = getParameterValueByName_2 == getParameterValueByName
filterByBoolMask = List.FilterByBoolMask(list=all_elements_in_active_view, mask=eq)

# group: Separate assembled from unassembled elements
code_block_3 = CodeBlock { "Spool Tag"; }
getParameterValueByName_3 = Element.GetParameterValueByName(element=filterByBoolMask.in, parameterName=code_block_3)
length = String.Length(str=getParameterValueByName_3)
code_block_4 = CodeBlock { 0; }
gt = length > code_block_4
filterByBoolMask_2 = List.FilterByBoolMask(list=filterByBoolMask.in, mask=gt)

# group: Group by Assembly
code_block_5 = CodeBlock { "Spool Tag"; }
getParameterValueByName_4 = Element.GetParameterValueByName(element=filterByBoolMask_2.in, parameterName=code_block_5)
groupByKey = List.GroupByKey(list=filterByBoolMask_2.in, keys=getParameterValueByName_4)

# group: Sort by Pipe Length
code_block_6 = CodeBlock { "Length"; }
getParameterValueByName_5 = Element.GetParameterValueByName(element=groupByKey.groups, parameterName=code_block_6)
code_block_7 = CodeBlock { 0; ""; }
eq_2 = _ == code_block_7.out1  # unwired: x
replaceByCondition = Replace(item=getParameterValueByName_5, replaceWith=code_block_7.out0, condition=eq_2)
sortByKey = List.SortByKey(list=groupByKey.groups@L2, keys=replaceByCondition@L2)
firstItem = List.FirstItem(list=sortByKey.sorted_list@L2)

# group: Filter Elements that are on a point (not pipes)
getLocation = Element.GetLocation(element=firstItem)
string_from_object = FromObject(obj=getLocation)
code_block_8 = CodeBlock { "Point"; }
startsWith = String.StartsWith(str=string_from_object, searchFor=code_block_8)
not_pipes_pipes = List.FilterByBoolMask(list=firstItem, mask=startsWith)
points_lines = List.FilterByBoolMask(list=getLocation, mask=startsWith)

# group: Tag Types
family_types = FamilyTypes("STRATUS Spool Tag - Multi-Category:STRATUS Spool Tag - Multi-Category")
family_types_2 = FamilyTypes("Pipe Tag QTC:Spool Tag")

boolean = BoolSelector(true)

# group: Assembly Tag (Not Pipes)
create_tag = Custom[Create Tag](view=code_block.pass, element=not_pipes_pipes.in, TagLocation=points_lines.in, TagType=family_types, addLeader=boolean, RunIt=boolean)  # package Genius Loci; Works only in Revit 2018 and later. Creates a tag at a given location, of given type and in a supplied view. The node also works with Linked Elements (except space and area), Multi Category tag and Material Tag. Based on an archilab node

length_2 = Curve.Length(curve=points_lines.out)

# group: Get Midpoint of line
code_block_9 = CodeBlock(x=length_2) { x/2; }
pointAtSegmentLength = Curve.PointAtSegmentLength(curve=points_lines.out, segmentLength=code_block_9)

# group: Sort pipes by under/over length
pipe_length = DoubleSlider(3, range=0..100 step 0.1)
gt_2 = length_2 > pipe_length
filterByBoolMask_3 = List.FilterByBoolMask(list=not_pipes_pipes.out, mask=gt_2)
filterByBoolMask_4 = List.FilterByBoolMask(list=pointAtSegmentLength, mask=gt_2)

# group: Assembly Tag (pipes under length)
create_tag_2 = Custom[Create Tag](view=code_block.pass, element=filterByBoolMask_3.out, TagLocation=filterByBoolMask_4.out, TagType=family_types, addLeader=boolean, RunIt=boolean)

# group: Assembly Tag (pipes over length)
create_tag_3 = Custom[Create Tag](view=code_block.pass, element=filterByBoolMask_3.in, TagLocation=filterByBoolMask_4.in, TagType=family_types_2, RunIt=boolean)

count = List.Count(list=current_selection)
code_block_10 = CodeBlock(packagename=getParameterValueByName, count=count)
# ---------- code_block_10.designscript (6 lines) ----------
true;
msg1="Tagged Package"+packagename;
msg2="Select an element from the
package you want to tag and run again";
count==0?msg2:msg1;
count;
# ----------------------------------------
python_script = Python(IN[0]=code_block_10.out0, IN[1]=code_block_10.out3)
# ---------- python_script.python (20 lines) ----------
import clr
#add a reference to the Revit UI .dll so we can access the UI Namespace...
clr.AddReference('RevitAPIUI')
#import everything from the UI Namespace...
from Autodesk.Revit.UI import *
 
#IN Variables...
enabled = IN[0]
list = IN[1]
 
msg = " ".join(list)
 #check if enabled is True, if it is then show message...
if enabled:
     #show the message dialog box...
     TaskDialog.Show("Tag Assemblies", msg)
     #return a result in Dynamo...
     OUT = "Got the message"
else:
     #return a result in Dynamo...
     OUT = "Enabled needs to be set to True to run"
# ----------------------------------------
watch = Watch(code_block_10.out3)
