# Dynamo graph View Filters - System Type 2.1_script.dyn (Dynamo 2.16.2.5624)
# packages: archi-lab.net 2019.2.1, archi-lab.net 2021.25.2721

current = Document.Current()
activeView = Document.ActiveView(document=current)
create_filters_remove_filters = BoolSelector(true)  # graph input

# group: Get all Piping Elements
code_block = CodeBlock()
# ---------- code_block.designscript (4 lines) ----------
[Category.ByName("Pipes"),
Category.ByName("Pipe Fittings"),
Category.ByName("Pipe Accessories"),
Category.ByName("Plumbing Fixtures")];
# ----------------------------------------
all_elements_of_category_in_view = ElementsOfCategoryInView(Category=code_block, View=activeView)

# group: Get System Type
code_block_2 = CodeBlock { "System Type"; }
getParameterValueByName = Element.GetParameterValueByName(element=all_elements_of_category_in_view, parameterName=code_block_2)

# group: Group and Sort
code_block_3 = CodeBlock(list=all_elements_of_category_in_view, list2=getParameterValueByName) { List.Flatten(list,1); List.Flatten(list2,1); }
groupByKey = List.GroupByKey(list=code_block_3.out0, keys=code_block_3.out1)
name = Element.Name(element=groupByKey.uniqueKeys)

code_block_4 = CodeBlock { ""; }
isNull = Object.IsNull()  # unwired: object
replaceByCondition = Replace(item=name, replaceWith=code_block_4, condition=isNull)

# group (continued): Group and Sort
sort = List.Sort(list=replaceByCondition)

# group: Create Names
code_block_5 = CodeBlock(b=sort) { Out="System_"+b; }

count = List.Count(list=sort)

# group: Filter Categories
code_block_6 = CodeBlock(amount=count)
# ---------- code_block_6.designscript (5 lines) ----------
List.OfRepeatedItem([Category.ByName("Pipes"),
Category.ByName("Pipe Fittings"),
Category.ByName("Pipe Accessories"),
Category.ByName("Plumbing Fixtures"),
Category.ByName("Pipe Insulations")],amount);
# ----------------------------------------

# group: Filter Parameter
code_block_7 = CodeBlock(list=all_elements_of_category_in_view) { pipes=list[0]; onepipe=pipes[0]; "System Type"; }
parameterByName = Parameter.ParameterByName(element=code_block_7.onepipe, name=code_block_7.out2)
ofRepeatedItem = List.OfRepeatedItem(item=parameterByName, amount=count)

# group: Filter Rule
code_block_8 = CodeBlock(x=count) { List.OfRepeatedItem("Equals",x); }
byRuleType = Revit.Filter.FilterRule.ByRuleType(type=code_block_8, value=sort, parameter=ofRepeatedItem, lacing=Longest)

# group: Create Filter
byRules = Revit.Filter.ParameterFilterElement.ByRules(name=code_block_5, categories=code_block_6, rules=byRuleType, lacing=Longest)

# group: Get Existing Filters and Remove from View
element_types = ElementTypes("FilterElement")
all_elements_of_type = ElementsOfType(element_type=element_types)
name_2 = Element.Name(element=all_elements_of_type)
code_block_9 = CodeBlock { "System_"; }
contains = String.Contains(string=name_2, searchFor=code_block_9)
filterByBoolMask = List.FilterByBoolMask(list=all_elements_of_type, mask=contains)
current_2 = Document.Current()
activeView_2 = Document.ActiveView(document=current_2)

# group: Collect Filters to Add (If True) and Sort
list_create = List.Create(item0=byRules, item1=filterByBoolMask.in)
code_block_10 = CodeBlock { "dummy"; 1; "null"; }
if_ = If(test=create_filters_remove_filters, true=list_create, false=code_block_10.out0)
flatten = List.Flatten(list=if_, amount=code_block_10.out1)
string_from_object = FromObject(obj=flatten)
allIndicesOf = List.AllIndicesOf(list=string_from_object, item=code_block_10.out2)
removeItemAtIndex = List.RemoveItemAtIndex(list=flatten, indices=allIndicesOf)
name_3 = Element.Name(element=removeItemAtIndex)
sortByKey = List.SortByKey(list=removeItemAtIndex, keys=name_3)

# group: Add Filters to View
addFilter = View.AddFilter(view=activeView, parameterFilter=sortByKey.sortedList)

# group: Find if Sleeve Accessories exist in Project
code_block_11 = CodeBlock { Category.ByName("Pipe Accessories"); }
all_elements_of_category_in_view_2 = ElementsOfCategoryInView(Category=code_block_11, View=activeView)
type = archilab.Revit.Elements.Elements.Type(element=all_elements_of_category_in_view_2)
code_block_12 = CodeBlock { "Alternate Description II"; }
getParameterValueByName_2 = Element.GetParameterValueByName(element=type, parameterName=code_block_12)
code_block_13 = CodeBlock { "Sleeve"; true; }
contains_2 = String.Contains(searchFor=code_block_13.out0, ignoreCase=code_block_13.out1)  # unwired: string
trueForAny = List.TrueForAny(list=getParameterValueByName_2, queryFunction=contains_2)
code_block_14 = CodeBlock { "Dummy"; }

# group: Create Filter For Sleeve Accessories
if_2 = If(test=trueForAny, true=type, false=code_block_14)
code_block_15 = CodeBlock(list=if_2)
# ---------- code_block_15.designscript (6 lines) ----------
"System_Sleeves ACC";
Category.ByName("Pipe Accessories");
"Contains";
"Sleeve";
List.FirstItem(list);
"Alternate Description II";
# ----------------------------------------
parameterByName_2 = Parameter.ParameterByName(element=code_block_15.out4, name=code_block_15.out5)
byRuleType_2 = Revit.Filter.FilterRule.ByRuleType(type=code_block_15.out2, value=code_block_15.out3, parameter=parameterByName_2, lacing=Longest)
byRules_2 = Revit.Filter.ParameterFilterElement.ByRules(name=code_block_15.out0, categories=code_block_15.out1, rules=byRuleType_2, lacing=Longest)

isNull_2 = Object.IsNull(object=byRules_2)

# group: Get Sleeves Acc Filter if existing
code_block_16 = CodeBlock { "System_Sleeves Acc"; }
eq = name_3 == code_block_16
filterByBoolMask_2 = List.FilterByBoolMask(list=removeItemAtIndex, mask=eq)

if_3 = RefactoredIf(test=isNull_2, true=filterByBoolMask_2.in, false=byRules_2)
apply_sleeves_acc_filter = CodeBlock(view2=addFilter, parameterfilterelement1=if_3)
# ---------- apply_sleeves_acc_filter.designscript (4 lines) ----------
view1 = Elements.View.AddFilter(view2, parameterfilterelement1);
color1 = Color.ByARGB(0, 255, 63, 0);
overridegraphicsettings1 = OverrideGraphicSettings.ByProperties(null, null, null, color1, null, null, null, null, -1, -1, -1, "Undefined", false);
view3 = Elements.View.SetFilterOverrides(view1, parameterfilterelement1, overridegraphicsettings1, true);
# ----------------------------------------
removeFilter = archilab.Revit.Views.Views.RemoveFilter(view=activeView_2, viewFilter=filterByBoolMask.in)

# group: Get Current Selection
python_script = Python()  # IronPython2; unwired: IN[0]
# ---------- python_script.python (21 lines) ----------
#Copyright(c) 2016, Dimitar Venkov
# @5devene, dimitar.ven@gmail.com

import clr

clr.AddReference("RevitNodes")
import Revit
clr.ImportExtensions(Revit.Elements)

clr.AddReference("RevitServices")
import RevitServices
from RevitServices.Persistence import DocumentManager
doc = DocumentManager.Instance.CurrentDBDocument
uidoc = DocumentManager.Instance.CurrentUIApplication.ActiveUIDocument

def output1(l1):
	if len(l1) == 1: return l1[0]
	else: return l1

selid = uidoc.Selection.GetElementIds()
OUT = output1([doc.GetElement(id).ToDSType(True) for id in selid])
# ----------------------------------------

# group: Get BOM#
code_block_17 = CodeBlock { "System Type"; }
getParameterValueByName_3 = Element.GetParameterValueByName(element=python_script, parameterName=code_block_17)

name_4 = Element.Name(element=getParameterValueByName_3)

# group: Separate filters of selected elements
contains_3 = String.Contains(string=sortByKey.sortedKeys, searchFor=name_4, lacing=CrossProduct)
if_any_true = Python(IN[0]=contains_3)  # IronPython2
# ---------- if_any_true.python (15 lines) ----------
# Load the Python Standard and DesignScript Libraries
import sys
import clr
clr.AddReference('ProtoGeometry')
from Autodesk.DesignScript.Geometry import *

# The inputs to this node will be stored as a list in the IN variables.
list = IN[0]
out = []
for sublist in list:
	if True in sublist:
		out.append(True)
	else:
		out.append(False)
OUT = out
# ----------------------------------------
filterByBoolMask_3 = List.FilterByBoolMask(list=sortByKey.sortedList, mask=if_any_true)

byProperties = Revit.Filter.OverrideGraphicSettings.ByProperties()

# group: Apply Overrides to 'Blank' Filter
boolean = BoolSelector(true)
setFilterOverrides = View.SetFilterOverrides(view=addFilter, parameterFilter=filterByBoolMask_3.in, overrides=byProperties, hide=boolean)

# group: Get Existing Filters and Remove from View
current_3 = Document.Current()
activeView_3 = Document.ActiveView(document=current_3)
element_types_2 = ElementTypes("FilterElement")
all_elements_of_type_2 = ElementsOfType(element_type=element_types_2)
name_5 = Element.Name(element=all_elements_of_type_2)
code_block_18 = CodeBlock { "System_"; }
contains_4 = String.Contains(string=name_5, searchFor=code_block_18)
filterByBoolMask_4 = List.FilterByBoolMask(list=all_elements_of_type_2, mask=contains_4)

removeFilter_2 = archilab.Revit.Views.Views.RemoveFilter(view=activeView_3, viewFilter=filterByBoolMask_4.in)

# group: Get System Type
code_block_19 = CodeBlock { "Support Discipline"; }
getParameterValueByName_4 = Element.GetParameterValueByName(element=all_elements_of_category_in_view, parameterName=code_block_19)

# group: Group and Sort
code_block_20 = CodeBlock(list=all_elements_of_category_in_view, list2=getParameterValueByName_4) { List.Flatten(list,1); List.Flatten(list2,1); }
groupByKey_2 = List.GroupByKey(list=code_block_20.out0, keys=code_block_20.out1)
code_block_21 = CodeBlock { ""; }
isNull_3 = Object.IsNull()  # unwired: object
replaceByCondition_2 = Replace(item=groupByKey_2.uniqueKeys, replaceWith=code_block_21, condition=isNull_3)
sort_2 = List.Sort(list=replaceByCondition_2)

# group: Create Names
code_block_22 = CodeBlock(b=sort_2) { Out="Support_"+b; }

count_2 = List.Count(list=sort_2)

# group: Filter Categories
code_block_23 = CodeBlock(amount=count_2)
# ---------- code_block_23.designscript (2 lines) ----------
DSCore.List.OfRepeatedItem([
Category.ByName("Pipe Accessories")],amount);
# ----------------------------------------

# group: Filter Parameter
code_block_24 = CodeBlock(list=all_elements_of_category_in_view) { PAs=list[2]; "Support Discipline"; }
parameterByName_3 = Parameter.ParameterByName(element=code_block_24.PAs, name=code_block_24.out1)
code_block_25 = CodeBlock { false; }
clean = List.Clean(list=parameterByName_3, preserveIndices=code_block_25)
code_block_26 = CodeBlock(list=clean) { list[0]; }
ofRepeatedItem_2 = List.OfRepeatedItem(item=code_block_26, amount=count_2)

# group: Filter Rule
code_block_27 = CodeBlock(x=count_2) { List.OfRepeatedItem("Equals",x); }
byRuleType_3 = Revit.Filter.FilterRule.ByRuleType(type=code_block_27, value=sort_2, parameter=ofRepeatedItem_2, lacing=Longest)

# group: Create Filter
byRules_3 = Revit.Filter.ParameterFilterElement.ByRules(name=code_block_22, categories=code_block_23, rules=byRuleType_3, lacing=Longest)

# group: Collect Filters to Add (If True) and Sort
list_create_2 = List.Create(item0=byRules_3, item1=filterByBoolMask_4.in)
code_block_28 = CodeBlock { 1; "null"; }
flatten_2 = List.Flatten(list=list_create_2, amount=code_block_28.out0)
string_from_object_2 = FromObject(obj=flatten_2)
allIndicesOf_2 = List.AllIndicesOf(list=string_from_object_2, item=code_block_28.out1)
removeItemAtIndex_2 = List.RemoveItemAtIndex(list=flatten_2, indices=allIndicesOf_2)
name_6 = Element.Name(element=removeItemAtIndex_2)
sortByKey_2 = List.SortByKey(list=removeItemAtIndex_2, keys=name_6)

# group: Add Filters to View
addFilter_2 = View.AddFilter(view=activeView, parameterFilter=sortByKey_2.sortedList)

# group: Get System Abbreviation
code_block_29 = CodeBlock { "System Abbreviation"; }
getParameterValueByName_5 = Element.GetParameterValueByName(element=python_script, parameterName=code_block_29)

name_7 = Element.Name(element=getParameterValueByName_5)

# group: Separate filters of selected elements
contains_5 = String.Contains(string=sortByKey_2.sortedKeys, searchFor=name_7, lacing=CrossProduct)
if_any_true_2 = Python(IN[0]=contains_5)  # IronPython2; same code as if_any_true
filterByBoolMask_5 = List.FilterByBoolMask(list=sortByKey_2.sortedList, mask=if_any_true_2)

byProperties_2 = Revit.Filter.OverrideGraphicSettings.ByProperties()

# group: Apply Overrides to 'Blank' Filter
code_block_30 = CodeBlock(list=filterByBoolMask_5.in) { List.Count(list)>=1?false:true; }
setFilterOverrides_2 = View.SetFilterOverrides(view=addFilter_2, parameterFilter=filterByBoolMask_5.out, overrides=byProperties_2, hide=code_block_30)

# group: Apply Overrides to 'Blank' Filter
boolean_2 = BoolSelector(true)
setFilterOverrides_3 = View.SetFilterOverrides(view=addFilter_2, parameterFilter=filterByBoolMask_5.in, overrides=byProperties_2, hide=boolean_2)

# group: Apply Overrides to 'Blank' Filter
code_block_31 = CodeBlock(list=filterByBoolMask_3.in) { List.Count(list)>=1?false:true; }
setFilterOverrides_4 = View.SetFilterOverrides(view=addFilter, parameterFilter=filterByBoolMask_3.out, overrides=byProperties, hide=code_block_31)
