# Dynamo graph Apply Std Rod Dia_script.dyn (Dynamo 2.16.4.10216)

categories = Categories("OST_PipeAccessory")
current = Document.Current()
activeView = Document.ActiveView(document=current)
all_elements_of_category_in_view = ElementsOfCategoryInView(Category=categories, View=activeView)
check_for_qtc_pipe_size = Python(IN[0]=all_elements_of_category_in_view)  # "Check for QTC Pipe Size Parameter"; CPython3
# ---------- check_for_qtc_pipe_size.python (26 lines) ----------
# Import necessary libraries
import clr
clr.AddReference('RevitServices')
from RevitServices.Persistence import DocumentManager
from RevitServices.Transactions import TransactionManager
clr.AddReference('RevitAPI')
from Autodesk.Revit.DB import *

# Get the current Revit document
doc = DocumentManager.Instance.CurrentDBDocument

# Define the input list of pipe accessory elements
pipe_accessories = UnwrapElement(IN[0])  # Unwrap Dynamo elements to Revit elements

# Initialize a list to store elements with the "QTC Pipe Size" parameter
elements_with_qtc_pipe_size = []

# Iterate through each pipe accessory element
for element in pipe_accessories:
    # Check if the element has the "QTC Pipe Size" parameter
    param = element.LookupParameter("QTC Pipe Size")
    if param is not None:
        elements_with_qtc_pipe_size.append(element)

# Output the filtered list of elements
OUT = elements_with_qtc_pipe_size
# ----------------------------------------
code_block = CodeBlock { "Rod Diameter"; }
code_block_2 = CodeBlock { "QTC Pipe Size"; }
getParameterValueByName = Element.GetParameterValueByName(element=check_for_qtc_pipe_size, parameterName=code_block_2)
code_block_3 = CodeBlock(ft=getParameterValueByName) { inches=ft*12; }
code_block_4 = CodeBlock { 0.375; 4.9; 0.5; 9.9; 0.625; 11.9; 0.75; }
python_script = Python(IN[0]=code_block_3, IN[1]=code_block_4.out0, IN[2]=code_block_4.out1, IN[3]=code_block_4.out2, IN[4]=code_block_4.out3, IN[5]=code_block_4.out4, IN[6]=code_block_4.out5, IN[7]=code_block_4.out6)  # CPython3
# ---------- python_script.python (52 lines) ----------
# Import necessary libraries
import clr
clr.AddReference('System.Windows.Forms')
clr.AddReference('System.Drawing')
from System.Windows.Forms import MessageBox, MessageBoxButtons, MessageBoxIcon, Form, Button, Label, DialogResult
from System.Drawing import Point, Size

# Define the input variables
size = IN[0]  # List of pipe sizes
rodsize1 = IN[1]
pipesize2 = IN[2]
rodsize2 = IN[3]
pipesize3 = IN[4]
rodsize3 = IN[5]
pipesize4 = IN[6]
rodsize4 = IN[7]

# Initialize lists to store output rod sizes and elements outside the range
output_rod_sizes = []
outside_range_elements = []

# Iterate through each pipe size and corresponding element
for s in size:
    if s < pipesize2:
        output_rod_sizes.append(rodsize1)
    elif pipesize2 <= s < pipesize3:
        output_rod_sizes.append(rodsize2)
    elif pipesize3 <= s < pipesize4:
        output_rod_sizes.append(rodsize3)
    elif pipesize4 <= s <= 20:
        output_rod_sizes.append(rodsize4)
    else:
        # Explicitly check for sizes <= 0 or > 20
        if s <= 0 or s > 20:
            outside_range_elements.append(element)

# Count the number of hangers outside the range
outside_range_count = len(outside_range_elements)

# Only show popups if there are hangers outside the range
if outside_range_count > 0:
    # Create the popup message
    popup_message = f"{outside_range_count} Hangers have QTC Pipe Size that is  greater than 20"
    popup_title = "Hangers Outside Acceptable Range"
    popup_buttons = MessageBoxButtons.OK
    popup_icon = MessageBoxIcon.Warning

    # Show the popup
    MessageBox.Show(popup_message, popup_title, popup_buttons, popup_icon)

# Output the rod sizes
OUT = output_rod_sizes
# ----------------------------------------
setParameterByName = Element.SetParameterByName(element=check_for_qtc_pipe_size, parameterName=code_block, value=python_script)
