# Dynamo graph HighlightSlopedPipes_script.dyn (Dynamo 2.6.1.8786)
# packages: archi-lab.net 2020.23.11

# group: Gets all Pipes in View
categories = Categories("OST_PipeCurves")
current = Document.Current()
activeView = Document.ActiveView(document=current)
all_elements_of_category_in_view = ElementsOfCategoryInView(Category=categories, View=activeView)

# group: Filter out vertical pipes
code_block = CodeBlock(pipes=all_elements_of_category_in_view) { lines = Elements.View3D.GetLocation(pipes); waitfor; }  # unwired: waitfor
direction = Line.Direction(line=code_block.lines)
X = Vector.X(vector=direction)
Y = Vector.Y(vector=direction)
code_block_2 = CodeBlock(xvec=X, yvec=Y) { zeroXY=xvec==0&&yvec==0; }

filterByBoolMask = List.FilterByBoolMask(list=all_elements_of_category_in_view, mask=code_block_2)
code_block_3 = CodeBlock(list=filterByBoolMask.out)
# ---------- code_block_3.designscript (5 lines) ----------
Elements.Element.GetParameterValueByName(list,"Slope");
eighthtol=0.010;
sixteenthtol=0.010;
fortyfivetol=0.010;
steamtol=0.005;
# ----------------------------------------
code_block_4 = CodeBlock(slopes=code_block_3.out0, eighthtol=code_block_3.eighthtol, sixteenthtol=code_block_3.sixteenthtol, steamtol=code_block_3.steamtol, fortyfivetol=code_block_3.fortyfivetol)
# ---------- code_block_4.designscript (7 lines) ----------
zero=slopes==0;
eighth=slopes>0.125-eighthtol&&slopes<0.125+eighthtol;
sixteenth=slopes>0.0625-sixteenthtol&&slopes<0.0625+sixteenthtol;
quarterinten=slopes>0.025-sixteenthtol&&slopes<0.025+sixteenthtol;
halfinten=slopes>0.05-steamtol&&slopes<0.05+steamtol;
fortyfive=slopes>12-fortyfivetol&&slopes<12+fortyfivetol;
any=zero||eighth||sixteenth||quarterinten||halfinten||fortyfive;
# ----------------------------------------
relay = Relay(code_block_4.any)

# group: Color odd slopes
code_block_5 = CodeBlock { false; }
isNull = Object.IsNull()  # unwired: obj
replaceByCondition = Replace(item=relay, replaceWith=code_block_5, condition=isNull)
filterByBoolMask_2 = List.FilterByBoolMask(list=filterByBoolMask.out, mask=replaceByCondition)
color_palette = ColorPalette({R: 165, G: 42, B: 42, A: 255})
overrideColorInView = Element.OverrideColorInView(element=filterByBoolMask_2.out, color=color_palette)

# group: Color 1/8 slopes
code_block_6 = CodeBlock { false; }
isNull_2 = Object.IsNull()  # unwired: obj
replaceByCondition_2 = Replace(item=code_block_4.eighth, replaceWith=code_block_6, condition=isNull_2)
filterByBoolMask_3 = List.FilterByBoolMask(list=filterByBoolMask.out, mask=replaceByCondition_2)
color_palette_2 = ColorPalette({R: 0, G: 100, B: 0, A: 255})
overrideColorInView_2 = Element.OverrideColorInView(element=filterByBoolMask_3.in, color=color_palette_2)

# group: Color 1/16 slopes
code_block_7 = CodeBlock { false; }
isNull_3 = Object.IsNull()  # unwired: obj
replaceByCondition_3 = Replace(item=code_block_4.sixteenth, replaceWith=code_block_7, condition=isNull_3)
filterByBoolMask_4 = List.FilterByBoolMask(list=filterByBoolMask.out, mask=replaceByCondition_3)
color_palette_3 = ColorPalette({R: 255, G: 215, B: 0, A: 255})
overrideColorInView_3 = Element.OverrideColorInView(element=filterByBoolMask_4.in, color=color_palette_3)

pipe_slopes = Watch(code_block_3.out0)

# group: Color 1/4 in 10 Feet slopes (Steam)
code_block_8 = CodeBlock { false; }
isNull_4 = Object.IsNull()  # unwired: obj
replaceByCondition_4 = Replace(item=code_block_4.quarterinten, replaceWith=code_block_8, condition=isNull_4)
filterByBoolMask_5 = List.FilterByBoolMask(list=filterByBoolMask.out, mask=replaceByCondition_4)
color_palette_4 = ColorPalette({R: 184, G: 134, B: 11, A: 255})
overrideColorInView_4 = Element.OverrideColorInView(element=filterByBoolMask_5.in, color=color_palette_4)

# group: Color 1/2 in 10 Feet slopes
code_block_9 = CodeBlock { false; }
isNull_5 = Object.IsNull()  # unwired: obj
replaceByCondition_5 = Replace(item=code_block_4.halfinten, replaceWith=code_block_9, condition=isNull_5)
filterByBoolMask_6 = List.FilterByBoolMask(list=filterByBoolMask.out, mask=replaceByCondition_5)
color_palette_5 = ColorPalette({R: 139, G: 69, B: 19, A: 255})
overrideColorInView_5 = Element.OverrideColorInView(element=filterByBoolMask_6.in, color=color_palette_5)
