# Dynamo graph Check BOM Description.dyn "Check BOM Description_script" (Dynamo 2.19.3.6394)

code_block = CodeBlock()
# ---------- code_block.designscript (4 lines) ----------
list=["Pipes","Pipe Fittings",
"Pipe Accessories","Mechanical Equipment",
"Plumbing Fixtures"];
Category.ByName(list);
# ----------------------------------------
current = Document.Current()
activeView = Document.ActiveView(document=current)
all_elements_of_category_in_view = ElementsOfCategoryInView(Category=code_block.out1, View=activeView)
elementType = Element.ElementType(element=all_elements_of_category_in_view)
code_block_2 = CodeBlock(list=all_elements_of_category_in_view, typelist=elementType)
# ---------- code_block_2.designscript (6 lines) ----------
flist=List.Flatten(list,1);
Elements.Element.GetParameterValueByName(flist,"QTC BOM Description");
Elements.Element.GetParameterValueByName(flist,"Alternate Description II");
ftypelist=List.Flatten(typelist,1);
Elements.Element.GetParameterValueByName(ftypelist,"QTC BOM Description");
Elements.Element.GetParameterValueByName(ftypelist,"Alternate Description II");
# ----------------------------------------
length = String.Length(string=code_block_2.out1@L1)
length_2 = String.Length(string=code_block_2.out2@L1)
length_3 = String.Length(string=code_block_2.out4@L1)
length_4 = String.Length(string=code_block_2.out5@L1)
code_block_3 = CodeBlock(qtcBOM=length, AltDescII=length_2, qtcBOMtype=length_3, AltDescIItype=length_4)
# ---------- code_block_3.designscript (3 lines) ----------
qtcBOM==0&&AltDescII==0
&&qtcBOMtype==0
&&AltDescIItype==0;
# ----------------------------------------
filterByBoolMask = List.FilterByBoolMask(list=code_block_2.flist, mask=code_block_3)
isolate_selected_elements = Python(IN[0]=filterByBoolMask.in, IN[1]=activeView)  # CPython3
# ---------- isolate_selected_elements.python (27 lines) ----------
import clr
clr.AddReference('RevitAPI')
from Autodesk.Revit.DB import *
from System.Collections.Generic import *

clr.AddReference("RevitServices")
import RevitServices
from RevitServices.Persistence import DocumentManager
from RevitServices.Transactions import TransactionManager

def TempIsolateElements(view, items):
	if not items: return False
	elif not isinstance(items, list): items = [items]
	ielements = List[ElementId]([x.Id for x in UnwrapElement(items)])
	try:
		UnwrapElement(view).IsolateElementsTemporary(ielements)
		return True
	except: return False

doc = DocumentManager.Instance.CurrentDBDocument

TransactionManager.Instance.EnsureInTransaction(doc)
if isinstance(IN[1], list):
	if isinstance(IN[0], list): OUT = [TempIsolateElements(x, y) for x, y in zip(IN[1], IN[0])]
	else: OUT = [TempIsolateElements(x, IN[0]) for x in IN[1]]
else: OUT = TempIsolateElements(IN[1], IN[0])
TransactionManager.Instance.TransactionTaskDone()
# ----------------------------------------
