# Dynamo graph IsolatePackage1.1_script.dyn "IsolatePackage_script1.1" (Dynamo 2.19.3.6394)

code_block = CodeBlock()
# ---------- code_block.designscript (10 lines) ----------
Category.ByName("Pipes");
Category.ByName("Pipe Fittings");
Category.ByName("Pipe Accessories");
Category.ByName("Plumbing Fixtures");
Category.ByName("Air Terminals");
Category.ByName("Duct Accessories");
Category.ByName("Duct Fittings");
Category.ByName("Ducts");
Category.ByName("Mechanical Equipment");
Category.ByName("Plumbing Equipment");
# ----------------------------------------
current = Document.Current()
activeView = Document.ActiveView(document=current)
all_elements_of_category_in_view = ElementsOfCategoryInView(Category=code_block.out0, View=activeView)
all_elements_of_category_in_view_2 = ElementsOfCategoryInView(Category=code_block.out1, View=activeView)
all_elements_of_category_in_view_3 = ElementsOfCategoryInView(Category=code_block.out2, View=activeView)
all_elements_of_category_in_view_4 = ElementsOfCategoryInView(Category=code_block.out3, View=activeView)
all_elements_of_category_in_view_5 = ElementsOfCategoryInView(Category=code_block.out4, View=activeView)
all_elements_of_category_in_view_6 = ElementsOfCategoryInView(Category=code_block.out5, View=activeView)
all_elements_of_category_in_view_7 = ElementsOfCategoryInView(Category=code_block.out6, View=activeView)
all_elements_of_category_in_view_8 = ElementsOfCategoryInView(Category=code_block.out7, View=activeView)
all_elements_of_category_in_view_9 = ElementsOfCategoryInView(Category=code_block.out8, View=activeView)
list_create = List.Create(item0=all_elements_of_category_in_view, item1=all_elements_of_category_in_view_2, item2=all_elements_of_category_in_view_3, item3=all_elements_of_category_in_view_4, item4=all_elements_of_category_in_view_5, item5=all_elements_of_category_in_view_6, item6=all_elements_of_category_in_view_7, item7=all_elements_of_category_in_view_8, item8=all_elements_of_category_in_view_9)
code_block_2 = CodeBlock(list=list_create) { DSCore.List.Flatten(list,1); }
code_block_3 = CodeBlock { "STRATUS Package Name"; }
getParameterValueByName = Element.GetParameterValueByName(element=code_block_2, parameterName=code_block_3)

# group: Get Current Selection
python_script = Python()  # CPython3; unwired: IN[0]
# ---------- python_script.python (21 lines) ----------
#Copyright(c) 2016, Dimitar Venkov
# @5devene, dimitar.ven@gmail.com

import clr

clr.AddReference("RevitNodes")
import Revit
clr.ImportExtensions(Revit.Elements)

clr.AddReference("RevitServices")
import RevitServices
from RevitServices.Persistence import DocumentManager
doc = DocumentManager.Instance.CurrentDBDocument
uidoc = DocumentManager.Instance.CurrentUIApplication.ActiveUIDocument

def output1(l1):
	if len(l1) == 1: return l1[0]
	else: return l1

selid = uidoc.Selection.GetElementIds()
OUT = output1([doc.GetElement(id).ToDSType(True) for id in selid])
# ----------------------------------------

code_block_4 = CodeBlock { "STRATUS Package Name"; }
getParameterValueByName_2 = Element.GetParameterValueByName(element=python_script, parameterName=code_block_4)

# group: Filter Elements in View that Match Selection
groupByKey = List.GroupByKey(list=getParameterValueByName_2, keys=getParameterValueByName_2)
eq = getParameterValueByName == groupByKey.uniqueKeys  # lacing=CrossProduct
if_any_true = Python(IN[0]=eq)  # CPython3
# ---------- if_any_true.python (15 lines) ----------
# Load the Python Standard and DesignScript Libraries
import sys
import clr
clr.AddReference('ProtoGeometry')
from Autodesk.DesignScript.Geometry import *

# The inputs to this node will be stored as a list in the IN variables.
list = IN[0]
out = []
for sublist in list:
	if True in sublist:
		out.append(True)
	else:
		out.append(False)
OUT = out
# ----------------------------------------
filterByBoolMask = List.FilterByBoolMask(list=code_block_2, mask=if_any_true)

# group: Isolate Elements in View
current_2 = Document.Current()
activeView_2 = Document.ActiveView(document=current_2)
isolate_selected_elements = Python(IN[0]=filterByBoolMask.in, IN[1]=activeView_2)  # CPython3
# ---------- isolate_selected_elements.python (27 lines) ----------
import clr
clr.AddReference('RevitAPI')
from Autodesk.Revit.DB import *
from System.Collections.Generic import *

clr.AddReference("RevitServices")
import RevitServices
from RevitServices.Persistence import DocumentManager
from RevitServices.Transactions import TransactionManager

def TempIsolateElements(view, items):
	if not items: return False
	elif not isinstance(items, list): items = [items]
	ielements = List[ElementId]([x.Id for x in UnwrapElement(items)])
	try:
		UnwrapElement(view).IsolateElementsTemporary(ielements)
		return True
	except: return False

doc = DocumentManager.Instance.CurrentDBDocument

TransactionManager.Instance.EnsureInTransaction(doc)
if isinstance(IN[1], list):
	if isinstance(IN[0], list): OUT = [TempIsolateElements(x, y) for x, y in zip(IN[1], IN[0])]
	else: OUT = [TempIsolateElements(x, IN[0]) for x in IN[1]]
else: OUT = TempIsolateElements(IN[1], IN[0])
TransactionManager.Instance.TransactionTaskDone()
# ----------------------------------------

sytems_isolated = Watch(getParameterValueByName_2)  # graph output
