# Dynamo graph View Filters - STRATUS Package Name_script.dyn (Dynamo 2.6.1.8786)
# packages: archi-lab.net 2019.2.1

# group: Get all Piping Elements
code_block = CodeBlock()
# ---------- code_block.designscript (4 lines) ----------
[Category.ByName("Pipes"),
Category.ByName("Pipe Fittings"),
Category.ByName("Pipe Accessories"),
Category.ByName("Plumbing Fixtures")];
# ----------------------------------------
all_elements_of_category = ElementsOfCategory(Category=code_block)

# group: Get Existing Filters and Remove from View
current = Document.Current()
activeView = Document.ActiveView(document=current)
element_types = ElementTypes("FilterElement")
all_elements_of_type = ElementsOfType(element_type=element_types)
name = Element.Name(element=all_elements_of_type)
code_block_2 = CodeBlock { "Package_"; }
contains = String.Contains(str=name, searchFor=code_block_2)
filterByBoolMask = List.FilterByBoolMask(list=all_elements_of_type, mask=contains)
removeFilter = archilab.Revit.Views.Views.RemoveFilter(view=activeView, viewFilter=filterByBoolMask.in)

# group: QTC Package Name Filters
package_filters_false_to_remove = BoolSelector(true)  # graph input

current_2 = Document.Current()
activeView_2 = Document.ActiveView(document=current_2)
all_elements_of_category_in_view = ElementsOfCategoryInView(Category=code_block, View=activeView_2)

# group: Get BOM#
code_block_3 = CodeBlock { "STRATUS Package Name"; }
getParameterValueByName = Element.GetParameterValueByName(element=all_elements_of_category_in_view, parameterName=code_block_3)

# group: Group and Sort
code_block_4 = CodeBlock(list=all_elements_of_category_in_view, list2=getParameterValueByName) { List.Flatten(list,1); List.Flatten(list2,1); }
groupByKey = List.GroupByKey(list=code_block_4.out0, keys=code_block_4.out1)
string_from_object = FromObject(obj=groupByKey.unique_keys)
sort = List.Sort(list=string_from_object)

# group: Create Names
code_block_5 = CodeBlock { "Blank"; ""; }
eq = _ == code_block_5.out1  # unwired: x
replaceByCondition = Replace(item=sort, replaceWith=code_block_5.out0, condition=eq)
code_block_6 = CodeBlock(b=replaceByCondition) { Out="Package_"+b; }

count = List.Count(list=sort)

# group: Filter Parameter
code_block_7 = CodeBlock { Category.ByName("Pipes"); "STRATUS Package Name"; }
all_elements_of_category_2 = ElementsOfCategory(Category=code_block_7.out0)
code_block_8 = CodeBlock(In=code_block_4.out0) { In[0]; }
parameterByName = Parameter.ParameterByName(element=code_block_8, name=code_block_7.out1)
ofRepeatedItem = List.OfRepeatedItem(item=parameterByName, amount=count)

# group: Filter Categories
code_block_9 = CodeBlock(amount=count)
# ---------- code_block_9.designscript (4 lines) ----------
List.OfRepeatedItem([Category.ByName("Pipes"),
Category.ByName("Pipe Fittings"),
Category.ByName("Pipe Accessories"),
Category.ByName("Plumbing Fixtures")],amount);
# ----------------------------------------

# group: Filter Rule
code_block_10 = CodeBlock(x=count) { List.OfRepeatedItem("Equals",x); }
byRuleType = Revit.Filter.FilterRule.ByRuleType(type=code_block_10, value=sort, parameter=ofRepeatedItem, lacing=Longest)

# group: Create Filter
byRules = Revit.Filter.ParameterFilterElement.ByRules(name=code_block_6, categories=code_block_9, rules=byRuleType, lacing=Longest)

# group: Collect Filters to Add (If True) and Sort
list_create = List.Create(item0=byRules, item1=filterByBoolMask.in)
code_block_11 = CodeBlock { "dummy"; 1; "null"; }
if_ = If(test=package_filters_false_to_remove, true=list_create, false=code_block_11.out0)
flatten = List.Flatten(list=if_, amt=code_block_11.out1)
string_from_object_2 = FromObject(obj=flatten)
allIndicesOf = List.AllIndicesOf(list=string_from_object_2, item=code_block_11.out2)
removeItemAtIndex = List.RemoveItemAtIndex(list=flatten, indices=allIndicesOf)
name_2 = Element.Name(element=removeItemAtIndex)
sortByKey = List.SortByKey(list=removeItemAtIndex, keys=name_2)

# group: Add Filters to View
addFilter = View.AddFilter(view=removeFilter, parameterFilter=sortByKey.sorted_list)
