# Dynamo graph Hanger - Update System and BOP_script - Copy1.dyn "Hanger - Update System and BOP_script" (Dynamo 2.6.1.8786)
# packages: bimorphNodes 3.0.3

# group: All Pipe Accessories
categories = Categories("OST_PipeAccessory")
current = Document.Current()
activeView = Document.ActiveView(document=current)
all_elements_of_category_in_view = ElementsOfCategoryInView(Category=categories, View=activeView)

# group: Filter down to hangers with the 4 shared parameters used
code_block = CodeBlock(list=all_elements_of_category_in_view)
# ---------- code_block.designscript (5 lines) ----------
ins=Revit.Elements.Element.GetParameterValueByName(list,"QTC Insulation Thickness");
psize=Revit.Elements.Element.GetParameterValueByName(list,"QTC Pipe Size");
bop=Revit.Elements.Element.GetParameterValueByName(list,"BOP");
boi=Revit.Elements.Element.GetParameterValueByName(list,"BOI");
test = ins>=0 && psize>=0 && bop>=0 && boi>=0;
# ----------------------------------------
code_block_2 = CodeBlock { false; }
isNull = Object.IsNull()  # unwired: obj
replaceByCondition = Replace(item=code_block.test, replaceWith=code_block_2, condition=isNull)
filterByBoolMask = List.FilterByBoolMask(list=all_elements_of_category_in_view, mask=replaceByCondition)

# group: Create Hanger interferance solid
getLocation = Element.GetLocation(element=filterByBoolMask.in)
code_block_3 = CodeBlock { "Diameter"; }
getParameterValueByName = Element.GetParameterValueByName(element=filterByBoolMask.in, parameterName=code_block_3)
code_block_4 = CodeBlock(dia=getParameterValueByName) { rad = (dia+1.0) /(2*12); }
byCenterPointRadius = Sphere.ByCenterPointRadius(centerPoint=getLocation, radius=code_block_4)

# group: Get all pipes in view
categories_2 = Categories("OST_PipeCurves")
current_2 = Document.Current()
activeView_2 = Document.ActiveView(document=current_2)
all_elements_of_category_in_view_2 = ElementsOfCategoryInView(Category=categories_2, View=activeView_2)

intersectsSolid = Revit.Element.IntersectsSolid(solids=byCenterPointRadius, elements=all_elements_of_category_in_view_2)
count = List.Count(list=intersectsSolid.Element@L2)
code_block_5 = CodeBlock(ints=count) { multipipe = ints > 1; nopipe = ints < 1; multipipe||nopipe; }
filterByBoolMask_2 = List.FilterByBoolMask(list=filterByBoolMask.in, mask=code_block_5.multipipe)
code_block_6 = CodeBlock(element=filterByBoolMask_2.in) { name=Revit.Elements.Element.Name(element); id=Revit.Elements.Element.Id(element); name+" - " +id; }
hangers_intersecting_multiple = Watch(code_block_6.out2)  # "Hangers Intersecting Multiple Pipes"; graph output
filterByBoolMask_3 = List.FilterByBoolMask(list=filterByBoolMask.in, mask=code_block_5.nopipe)
code_block_7 = CodeBlock(element=filterByBoolMask_3.in) { name=Revit.Elements.Element.Name(element); id=Revit.Elements.Element.Id(element); name+" - " +id; }
hangers_intersecting_no_pipes = Watch(code_block_7.out2)  # graph output

# group: Get intersecting pipe
firstItem = List.FirstItem(list=intersectsSolid.Element@L2)

code_block_8 = CodeBlock(hanger=filterByBoolMask.in, pipe=firstItem)
# ---------- code_block_8.designscript (42 lines) ----------
hanger;
//Find location of the low end of the pipe
loc=Revit.Elements.Element.GetLocation(pipe);
start=Autodesk.DesignScript.Geometry.Curve.StartPoint(loc);
startz=Autodesk.DesignScript.Geometry.Point.Z(start);
end=Autodesk.DesignScript.Geometry.Curve.EndPoint(loc);
endz=Autodesk.DesignScript.Geometry.Point.Z(end);
lowend=startz<endz?start:end;
//Set elevation of point to 0
lowendx=Autodesk.DesignScript.Geometry.Point.X(lowend);
lowendy=Autodesk.DesignScript.Geometry.Point.Y(lowend);
pipeloc=Autodesk.DesignScript.Geometry.Point.ByCoordinates(lowendx,lowendy,0);
//Get pipe slope
slope=Revit.Elements.Element.GetParameterValueByName(pipe,"Slope");
//Get pipe Bottom Elevation
pbottom=Revit.Elements.Element.GetParameterValueByName(pipe,"Bottom Elevation");

//Get location of hanger
hloc=Revit.Elements.Element.GetLocation(hanger);
//Set elevation of point to 0
locx=Autodesk.DesignScript.Geometry.Point.X(hloc);
locy=Autodesk.DesignScript.Geometry.Point.Y(hloc);
hangloc=Autodesk.DesignScript.Geometry.Point.ByCoordinates(locx,locy,0);
//Get distance from pipe start to hanger location
dist=Autodesk.DesignScript.Geometry.DistanceTo(hangloc,pipeloc);
//Find BOP at hanger location
BOP=(slope*dist)/12+pbottom;
//Find center of Pipe at hanger location
CL=(slope*dist)/12+lowend;
//Round to 1/2"
bottomrnd = DSCore.Math.Round(BOP*(12*2))/(12*2);

//Get System Abbreviation
abb=Revit.Elements.Element.GetParameterValueByName(pipe,"System Abbreviation");
//Get Pipe Size
pSize=Revit.Elements.Element.GetParameterValueByName(pipe,"Diameter");
//Get Insulation Thickness
pIns=Revit.Elements.Element.GetParameterValueByName(pipe,"Insulation Thickness");
boi=bottomrnd-(pIns/12);
Pid=Revit.Elements.Element.Id(pipe);
Hsizerough=pSize+2*pIns-0.0625;
rodDia=pSize<=4?0.375:pSize<=8?0.5:pSize<=16?0.625:pSize<=20?0.75:1;
# ----------------------------------------
code_block_9 = CodeBlock { "Mark"; "BOP"; "Comments"; "QTC Pipe Size"; "QTC Insulation Thickness"; "BOI"; "QTC Pipe ID"; }
code_block_10 = CodeBlock(hangers=code_block_8.hanger, bottoms=code_block_8.bottomrnd, abbs=code_block_8.abb, pSize=code_block_8.pSize, pIns=code_block_8.pIns, boi=code_block_8.boi, pid=code_block_8.Pid) { tag="H-"+[1..List.Count(hangers)]; bottoms; abbs; pSize/12; pIns/12; boi; pid; }
code_block_11 = CodeBlock { 1; }
flatten = List.Flatten(list=code_block_10.tag, amt=code_block_11)
setParameterByName = Element.SetParameterByName(element=code_block_8.hanger, parameterName=code_block_9.out0, value=flatten)
setParameterByName_2 = Element.SetParameterByName(element=code_block_8.hanger, parameterName=code_block_9.out1, value=code_block_10.bottoms)
setParameterByName_3 = Element.SetParameterByName(element=code_block_8.hanger, parameterName=code_block_9.out2, value=code_block_10.abbs)
setParameterByName_4 = Element.SetParameterByName(element=code_block_8.hanger, parameterName=code_block_9.out3, value=code_block_10.out3)
setParameterByName_5 = Element.SetParameterByName(element=code_block_8.hanger, parameterName=code_block_9.out5, value=code_block_10.boi)
setParameterByName_6 = Element.SetParameterByName(element=code_block_8.hanger, parameterName=code_block_9.out6, value=code_block_10.pid)
all_elements_in_active_view = ElementsInView()

# group: View Overrides
color_palette = ColorPalette({R: 192, G: 192, B: 192, A: 255})
fill_patterns = FillPatterns("<Solid fill>")
code_block_12 = CodeBlock { 50; }
byProperties = Revit.Filter.OverrideGraphicSettings.ByProperties(cutFillColor=color_palette, projectionFillColor=color_palette, cutLineColor=color_palette, projectionLineColor=color_palette, cutFillPattern=fill_patterns, projectionFillPattern=fill_patterns, transparency=code_block_12)

overrideInView = Element.OverrideInView(element=all_elements_in_active_view, overrides=byProperties)
filterByBoolMask_4 = List.FilterByBoolMask(list=filterByBoolMask.in, mask=code_block_5.out2)
code_block_13 = CodeBlock(waitfor=overrideInView, pass=filterByBoolMask_4.in) { waitfor; pass; }
color_palette_2 = ColorPalette({R: 255, G: 69, B: 0, A: 255})
overrideColorInView = Element.OverrideColorInView(element=code_block_13.pass, color=color_palette_2)
setParameterByName_7 = Element.SetParameterByName(element=code_block_8.hanger, parameterName=code_block_9.out4, value=code_block_10.out4)
watch = Watch(code_block_8.hanger)
count_2 = List.Count(list=filterByBoolMask_4.in)
code_block_14 = CodeBlock(cnt=count_2) { cnt>0; "empty"; }
scopeIf = ScopedIf(test=code_block_14.out0, true=all_elements_in_active_view, false=code_block_14.out1)
