# Dynamo graph IsolateHydronic_script.dyn (Dynamo 2.6.1.8786)

isolate_selected_elements = Python()  # unwired: IN[0], IN[1]
# ---------- isolate_selected_elements.python (27 lines) ----------
import clr
clr.AddReference('RevitAPI')
from Autodesk.Revit.DB import *
from System.Collections.Generic import *

clr.AddReference("RevitServices")
import RevitServices
from RevitServices.Persistence import DocumentManager
from RevitServices.Transactions import TransactionManager

def TempIsolateElements(view, items):
	if not items: return False
	elif not isinstance(items, list): items = [items]
	ielements = List[ElementId]([x.Id for x in UnwrapElement(items)])
	try:
		UnwrapElement(view).IsolateElementsTemporary(ielements)
		return True
	except: return False

doc = DocumentManager.Instance.CurrentDBDocument

TransactionManager.Instance.EnsureInTransaction(doc)
if isinstance(IN[1], list):
	if isinstance(IN[0], list): OUT = [TempIsolateElements(x, y) for x, y in zip(IN[1], IN[0])]
	else: OUT = [TempIsolateElements(x, IN[0]) for x in IN[1]]
else: OUT = TempIsolateElements(IN[1], IN[0])
TransactionManager.Instance.TransactionTaskDone()
# ----------------------------------------
code_block = CodeBlock()
# ---------- code_block.designscript (4 lines) ----------
Category.ByName("Pipes");
Category.ByName("Pipe Fittings");
Category.ByName("Pipe Accessories");
Category.ByName("Plumbing Fixtures");
# ----------------------------------------
current = Document.Current()
activeView = Document.ActiveView(document=current)
all_elements_of_category_in_view = ElementsOfCategoryInView(Category=code_block.out0, View=activeView)
all_elements_of_category_in_view_2 = ElementsOfCategoryInView(Category=code_block.out1, View=activeView)
all_elements_of_category_in_view_3 = ElementsOfCategoryInView(Category=code_block.out2, View=activeView)
all_elements_of_category_in_view_4 = ElementsOfCategoryInView(Category=code_block.out3, View=activeView)
list_create = List.Create(item0=all_elements_of_category_in_view, item1=all_elements_of_category_in_view_2, item2=all_elements_of_category_in_view_3, item3=all_elements_of_category_in_view_4)
code_block_2 = CodeBlock(list=list_create) { DSCore.List.Flatten(list,1); }

# group: Get System Type
code_block_3 = CodeBlock { "System Type"; }
getParameterValueByName = Element.GetParameterValueByName(element=code_block_2, parameterName=code_block_3)
name = Family.Name(family=getParameterValueByName)

code_block_4 = CodeBlock { ""; }
isNull = Object.IsNull()  # unwired: obj
replaceByCondition = Replace(item=name, replaceWith=code_block_4, condition=isNull)
code_block_5 = CodeBlock { "return"; "supply"; true; }
contains = String.Contains(str=replaceByCondition, searchFor=code_block_5.out0, ignoreCase=code_block_5.out2)
contains_2 = String.Contains(str=replaceByCondition, searchFor=code_block_5.out1, ignoreCase=code_block_5.out2)
code_block_6 = CodeBlock(ret=contains, supply=contains_2) { ret||supply; }
filterByBoolMask = List.FilterByBoolMask(list=code_block_2, mask=code_block_6)

# group: Hide Elements in View
current_2 = Document.Current()
activeView_2 = Document.ActiveView(document=current_2)
hide_selected_elements = Python(IN[0]=filterByBoolMask.out, IN[1]=activeView_2)
# ---------- hide_selected_elements.python (27 lines) ----------
import clr
clr.AddReference('RevitAPI')
from Autodesk.Revit.DB import *
from System.Collections.Generic import *

clr.AddReference("RevitServices")
import RevitServices
from RevitServices.Persistence import DocumentManager
from RevitServices.Transactions import TransactionManager

def TempIsolateElements(view, items):
	if not items: return False
	elif not isinstance(items, list): items = [items]
	ielements = List[ElementId]([x.Id for x in UnwrapElement(items)])
	try:
		UnwrapElement(view).HideElementsTemporary(ielements)
		return True
	except: return False

doc = DocumentManager.Instance.CurrentDBDocument

TransactionManager.Instance.EnsureInTransaction(doc)
if isinstance(IN[1], list):
	if isinstance(IN[0], list): OUT = [TempIsolateElements(x, y) for x, y in zip(IN[1], IN[0])]
	else: OUT = [TempIsolateElements(x, IN[0]) for x in IN[1]]
else: OUT = TempIsolateElements(IN[1], IN[0])
TransactionManager.Instance.TransactionTaskDone()
# ----------------------------------------
