# Dynamo graph Create Package Spool Key Iso_script.dyn (Dynamo 2.6.1.8786)
# packages: archi-lab.net 2021.25.2721, Crumple 2022.5.27

categories = Categories("OST_PipeAccessory")
categories_2 = Categories("OST_PipeCurves")
categories_3 = Categories("OST_PipeFitting")
list_create = List.Create(item0=categories_2, item1=categories_3)
current = Document.Current()
activeView = Document.ActiveView(document=current)
all_elements_of_category_in_view = ElementsOfCategoryInView(Category=list_create, View=activeView)
code_block = CodeBlock { 2; }
flatten = List.Flatten(list=all_elements_of_category_in_view, amt=code_block)
code_block_2 = CodeBlock { "STRATUS Package Name"; }
getParameterValueByName = Element.GetParameterValueByName(element=flatten, parameterName=code_block_2)
current_selection = Python()  # unwired: IN[0]
# ---------- current_selection.python (21 lines) ----------
#Copyright(c) 2016, Dimitar Venkov
# @5devene, dimitar.ven@gmail.com

import clr

clr.AddReference("RevitNodes")
import Revit
clr.ImportExtensions(Revit.Elements)

clr.AddReference("RevitServices")
import RevitServices
from RevitServices.Persistence import DocumentManager
doc = DocumentManager.Instance.CurrentDBDocument
uidoc = DocumentManager.Instance.CurrentUIApplication.ActiveUIDocument

def output1(l1):
	if len(l1) == 1: return l1[0]
	else: return l1

selid = uidoc.Selection.GetElementIds()
OUT = output1([doc.GetElement(id).ToDSType(True) for id in selid])
# ----------------------------------------
code_block_3 = CodeBlock { "STRATUS Package Name"; }
getParameterValueByName_2 = Element.GetParameterValueByName(element=current_selection, parameterName=code_block_3)
contains = String.Contains(str=getParameterValueByName, searchFor=getParameterValueByName_2)
filterByBoolMask = List.FilterByBoolMask(list=flatten, mask=contains)
solids = Element.Solids(element=filterByBoolMask.in)
byUnion = Solid.ByUnion(solids=solids)
string_from_object = FromObject(obj=activeView)
code_block_4 = CodeBlock { "FloorPlanView"; "AxonmetricView"; }
contains_2 = String.Contains(str=string_from_object, searchFor=code_block_4.out0)
contains_3 = String.Contains(str=string_from_object, searchFor=code_block_4.out1)
code_block_5 = CodeBlock(plan=contains_2, iso=contains_3) { plan?"Plan":iso?"Iso":""; }
buffer_distance = DoubleInput(5)
geometry = Element.Geometry(element=filterByBoolMask.in)
boundingBox = Geometry.BoundingBox(geometry=geometry)
minPoint = BoundingBox.MinPoint(boundingBox=boundingBox)
X = Point.X(point=minPoint)
minimumItem = List.MinimumItem(list=X)
Y = Point.Y(point=minPoint)
minimumItem_2 = List.MinimumItem(list=Y)
Z = Point.Z(point=minPoint)
minimumItem_3 = List.MinimumItem(list=Z)
code_block_6 = CodeBlock(buff=buffer_distance, x=minimumItem, y=minimumItem_2, z=minimumItem_3) { buff; x-buff; y-buff; z-buff; }
byCoordinates = Point.ByCoordinates(x=code_block_6.out1, y=code_block_6.out2, z=code_block_6.out3)
maxPoint = BoundingBox.MaxPoint(boundingBox=boundingBox)
X_2 = Point.X(point=maxPoint)
maximumItem = List.MaximumItem(list=X_2)
Y_2 = Point.Y(point=maxPoint)
maximumItem_2 = List.MaximumItem(list=Y_2)
Z_2 = Point.Z(point=maxPoint)
maximumItem_3 = List.MaximumItem(list=Z_2)
code_block_7 = CodeBlock(buff=buffer_distance, x=maximumItem, y=maximumItem_2, z=maximumItem_3) { buff; x+buff; y+buff; z+buff; }
byCoordinates_2 = Point.ByCoordinates(x=code_block_7.out1, y=code_block_7.out2, z=code_block_7.out3)
byCorners = BoundingBox.ByCorners(min=byCoordinates, max=byCoordinates_2)
code_block_8 = CodeBlock(packageName=getParameterValueByName_2) { packageName + " - Spool Key "+ "Iso"; }
n3dview_by_boundingbox = Python(IN[0]=byCorners, IN[1]=code_block_8)  # "3DView by BoundingBox"
# ---------- n3dview_by_boundingbox.python (48 lines) ----------
import clr
clr.AddReference('RevitAPI')
import Autodesk
from Autodesk.Revit.DB import *

clr.AddReference('RevitNodes')
import Revit
clr.ImportExtensions(Revit.GeometryConversion)

clr.AddReference('RevitServices')
import RevitServices
from RevitServices.Persistence import DocumentManager
from RevitServices.Transactions import TransactionManager
doc = DocumentManager.Instance.CurrentDBDocument

def tolist(obj1):
    if hasattr(obj1,"__iter__"): return obj1
    else: return [obj1]

bboxs = tolist(IN[0])
viewNames = tolist(IN[1])
views=[]

#Get 3D View ViewFamilyType
viewTypeColl = FilteredElementCollector(doc).OfClass(ViewFamilyType)
for i in viewTypeColl:
	if i.ViewFamily == ViewFamily.ThreeDimensional:
		viewType = i
	else:
		continue

for bbox,viewName in zip(bboxs,viewNames):
	newmax = UnwrapElement(bbox.MaxPoint).ToRevitType()
	newmin = UnwrapElement(bbox.MinPoint).ToRevitType()
	newbox = BoundingBoxXYZ()
	newbox.Max = newmax
	newbox.Min = newmin
	try:
		TransactionManager.Instance.EnsureInTransaction(doc)
		view = View3D.CreateIsometric(doc, viewType.Id)
		view.Name = viewName
		view.SetSectionBox(newbox)
		views.append(view)
		TransactionManager.Instance.TransactionTaskDone()
	except Exception, ex:
		views.append(ex.message)

OUT = views
# ----------------------------------------
code_block_9 = CodeBlock { "Sub-Discipline"; "06 Spool Keys"; }
setParameterByName = Element.SetParameterByName(element=n3dview_by_boundingbox, parameterName=code_block_9.out0, value=code_block_9.out1)
view_templates = ViewTemplatesUi("QTC - Spool Template")
setViewTemplate = archilab.Revit.Views.Views.SetViewTemplate(view=setParameterByName, viewTemplate=view_templates)

# group: No selection error report
code_block_10 = CodeBlock(list=current_selection, package=getParameterValueByName_2)
# ---------- code_block_10.designscript (4 lines) ----------
test=DSCore.List.Count(list)>0;
test?"Spool Key":"Error";
test?"View created for Package " +package+" under '06 Spool Keys'":
"Select an element from the package before running!";
# ----------------------------------------

ui_messenger = Custom[© UI.Messenger](title=code_block_10.test, body=code_block_10.out1)  # package Crumple; Displays a message box with a title/body and OK/cancel button. If OK is selected, the third input's data will be passed through.
