# Dynamo graph script.dyn "Fix olet Sizes" (Dynamo 2.13.1.3887)

# group: Get all pipe fittings in the active view
categories = Categories("OST_PipeFitting")
current = Document.Current()
activeView = Document.ActiveView(document=current)
all_elements_of_category_in_view = ElementsOfCategoryInView(Category=categories, View=activeView)

# group: Filter to Olet Elements
code_block = CodeBlock(list=all_elements_of_category_in_view) { Elements.Element.GetParameterValueByName(list,"Family"); "olet"; "O-Let"; true; }
string_from_object = FromObject(obj=code_block.out0)
contains = String.Contains(string=string_from_object, searchFor=code_block.out1, ignoreCase=code_block.out3)
contains_2 = String.Contains(string=string_from_object, searchFor=code_block.out2, ignoreCase=code_block.out3)
code_block_2 = CodeBlock(A=contains, B=contains_2) { A||B; }
filterByBoolMask = List.FilterByBoolMask(list=all_elements_of_category_in_view, mask=code_block_2)

# group: Get connected elements
mep_connector_info_from_mep_over = Python(IN[0]=filterByBoolMask.in)  # CPython3
# ---------- mep_connector_info_from_mep_over.python (73 lines) ----------
import clr
import math

clr.AddReference("RevitServices")
import RevitServices
from RevitServices.Persistence import DocumentManager
from RevitServices.Transactions import TransactionManager
doc = DocumentManager.Instance.CurrentDBDocument

clr.AddReference("RevitAPI")
import Autodesk
from Autodesk.Revit.DB import *

clr.AddReference("RevitNodes")
import Revit
clr.ImportExtensions(Revit.Elements)
clr.ImportExtensions(Revit.GeometryConversion)
#The inputs to this node will be stored as a list in the IN variables.
if isinstance(IN[0], list):
	fittings = UnwrapElement(IN[0])
	toggle = 0
else:
	toggle = 1
	fittings = [UnwrapElement(IN[0])]
	
p = []
dir = []
rep = []
ref = []

for fitting in fittings:
	
	points = []
	direction = []
	report = []
	refs = []
	
	try:
		connectors = fitting.MEPModel.ConnectorManager.Connectors
	except:
		try:
			connectors = fitting.ConnectorManager.Connectors
		except:
			p.append(None)
			dir.append(None)
			rep.append(None)
			ref.append(None)
			continue
	for conn in connectors:
		points.append(conn.Origin.ToPoint())
		direction.append(conn.CoordinateSystem.BasisZ.ToVector())
		result = ""
		try:
			result += "Direction: " + conn.Direction.ToString()
		except:
			result += "Direction: N/A"
		#result += ", AllRefs Size: " + conn.AllRefs.Size.ToString()
		#result += ", Domain: " + conn.Domain.ToString()
		#result += ", Type: " + conn.ConnectorType.ToString()
		#report.append(result)
		for c in conn.AllRefs:
			refs.append(c.Owner)
	p.append(points)
	dir.append(direction)
	rep.append(report)
	ref.append(refs)


#Assign your output to the OUT variable.
if toggle:
	OUT = refs
else:
	OUT = ref
# ----------------------------------------

# group: Get Pipes from connected elements
getCategory = Element.GetCategory(element=mep_connector_info_from_mep_over)
string_from_object_2 = FromObject(obj=getCategory)
code_block_3 = CodeBlock(list=string_from_object_2) { list=="Pipes"; }
filterByBoolMask_2 = List.FilterByBoolMask(list=mep_connector_info_from_mep_over, mask=code_block_3)

# group: Find Larger pipe radius
code_block_4 = CodeBlock(list=filterByBoolMask_2.in)
# ---------- code_block_4.designscript (3 lines) ----------
flist=List.Flatten(list,1);
"Dummy Tap Radius1";
PipeRadInches=Elements.Element.GetParameterValueByName(list,"Diameter")/2;
# ----------------------------------------
sort = List.Sort(list=code_block_4.PipeRadInches@L2)
lastItem = List.LastItem(list=sort@L2)

setParameterByName = Element.SetParameterByName(element=filterByBoolMask.in, parameterName=code_block_4.out1, value=lastItem)
