# Dynamo graph Hanger - Apply Hanger PropertiesR23_script.dyn (Dynamo 2.13.1.3887)
# packages: bimorphNodes 5.1.3

# group: All Pipe Accessories
categories = Categories("OST_PipeAccessory")
current = Document.Current()
activeView = Document.ActiveView(document=current)
all_elements_of_category_in_view = ElementsOfCategoryInView(Category=categories, View=activeView)

# group: Filter down to Elements which have BOP Parameter
check_for_bop_parameter = Python(IN[0]=all_elements_of_category_in_view)  # CPython3
# ---------- check_for_bop_parameter.python (29 lines) ----------
import clr
clr.AddReference('RevitServices')
from RevitServices.Persistence import DocumentManager
from RevitServices.Transactions import TransactionManager

clr.AddReference('RevitAPI')
from Autodesk.Revit.DB import *

# Get the current Revit document
doc = DocumentManager.Instance.CurrentDBDocument

# The input element(s) to check
elements = UnwrapElement(IN[0])

# The parameter name to check for
param_name = "BOP"

# Function to check if the parameter exists
def parameter_exists(element, param_name):
    # Get the parameter by name
    param = element.LookupParameter(param_name)
    # Return True if the parameter exists, False otherwise
    return param is not None

# Check for the parameter in each element
results = [parameter_exists(element, param_name) for element in elements]

# Output the results
OUT = results
# ----------------------------------------
filterByBoolMask = List.FilterByBoolMask(list=all_elements_of_category_in_view, mask=check_for_bop_parameter)

# group: Create Hanger interferance solid
getLocation = Element.GetLocation(element=filterByBoolMask.in)
code_block = CodeBlock { "Diameter"; }
getParameterValueByName = Element.GetParameterValueByName(element=filterByBoolMask.in, parameterName=code_block)
code_block_2 = CodeBlock(dia=getParameterValueByName) { rad = (dia+2) /(2*12); }
byCenterPointRadius = Sphere.ByCenterPointRadius(centerPoint=getLocation, radius=code_block_2)

# group: Get all pipes in view
categories_2 = Categories("OST_PipeCurves")
current_2 = Document.Current()
activeView_2 = Document.ActiveView(document=current_2)
all_elements_of_category_in_view_2 = ElementsOfCategoryInView(Category=categories_2, View=activeView_2)

intersectsSolid = Revit.Element.IntersectsSolid(solids=byCenterPointRadius, elements=all_elements_of_category_in_view_2)
intersectingElements = Results.SolidIntersectionResult.IntersectingElements(solidIntersectionResult=intersectsSolid)
count = List.Count(list=intersectingElements@L2)
code_block_3 = CodeBlock(ints=count) { multipipe = ints > 1; nopipe = ints < 1; multipipe||nopipe; }
filterByBoolMask_2 = List.FilterByBoolMask(list=filterByBoolMask.in, mask=code_block_3.nopipe)
code_block_4 = CodeBlock(element=filterByBoolMask_2.in) { name=Revit.Elements.Element.Name(element); id=Revit.Elements.Element.Id(element); name+" - " +id; }
hangers_intersecting_no_pipes = Watch(code_block_4.out2)  # graph output
filterByBoolMask_3 = List.FilterByBoolMask(list=filterByBoolMask.in, mask=code_block_3.multipipe)
code_block_5 = CodeBlock(element=filterByBoolMask_3.in) { name=Revit.Elements.Element.Name(element); id=Revit.Elements.Element.Id(element); name+" - " +id; }
hangers_intersecting_multiple = Watch(code_block_5.out2)  # "Hangers Intersecting Multiple Pipes"; graph output
filterByBoolMask_4 = List.FilterByBoolMask(list=filterByBoolMask.in, mask=code_block_3.out2)
count_2 = List.Count(list=filterByBoolMask_4.in)
code_block_6 = CodeBlock(cnt=count_2) { cnt>0; }
all_elements_in_active_view = ElementsInView()
code_block_7 = CodeBlock(test=code_block_6, TrueList=all_elements_in_active_view) { indx = test ? 0 : 1; valueSet = [ TrueList, "Empty" ] [ indx ]; }

# group: View Overrides
color_palette = ColorPalette({R: 192, G: 192, B: 192, A: 255})
fill_patterns = FillPatterns("<Solid fill>")
code_block_8 = CodeBlock { 50; }
byProperties = Revit.Filter.OverrideGraphicSettings.ByProperties(cutFillColor=color_palette, projectionFillColor=color_palette, cutLineColor=color_palette, projectionLineColor=color_palette, cutFillPattern=fill_patterns, projectionFillPattern=fill_patterns, transparency=code_block_8)

overrideInView = Element.OverrideInView(element=code_block_7.valueSet, overrides=byProperties)
code_block_9 = CodeBlock(waitfor=overrideInView, pass=filterByBoolMask_4.in) { waitfor; pass; }
color_palette_2 = ColorPalette({R: 255, G: 69, B: 0, A: 255})
overrideColorInView = Element.OverrideColorInView(element=code_block_9.pass, color=color_palette_2)

# group: Get intersecting pipe
firstItem = List.FirstItem(list=intersectingElements@L2)

change_pipe_ref_level_to_match = CodeBlock(hangers=filterByBoolMask.in, pipes=firstItem)  # "Change Pipe Ref Level to Match Hanger"
# ---------- change_pipe_ref_level_to_match.designscript (5 lines) ----------
hangers;
pipes;
hngrefLevel=Revit.Elements.Element.GetParameterValueByName(hangers,"Level");
piperefLevel=Revit.Elements.Element.GetParameterValueByName(pipes,"Reference Level");
Revit.Elements.Element.SetParameterByName(pipes,"Reference Level",hngrefLevel);
# ----------------------------------------
code_block_10 = CodeBlock(hanger=change_pipe_ref_level_to_match.hangers, pipe=change_pipe_ref_level_to_match.pipes)
# ---------- code_block_10.designscript (42 lines) ----------
hanger;
//Find location of the low end of the pipe
loc=Revit.Elements.Element.GetLocation(pipe);
start=Autodesk.DesignScript.Geometry.Curve.StartPoint(loc);
startz=Autodesk.DesignScript.Geometry.Point.Z(start);
end=Autodesk.DesignScript.Geometry.Curve.EndPoint(loc);
endz=Autodesk.DesignScript.Geometry.Point.Z(end);
lowend=startz<endz?start:end;
//Set elevation of point to 0
lowendx=Autodesk.DesignScript.Geometry.Point.X(lowend);
lowendy=Autodesk.DesignScript.Geometry.Point.Y(lowend);
pipeloc=Autodesk.DesignScript.Geometry.Point.ByCoordinates(lowendx,lowendy,0);
//Get pipe slope
slope=Revit.Elements.Element.GetParameterValueByName(pipe,"Slope");
//Get pipe Bottom Elevation
pbottom=Revit.Elements.Element.GetParameterValueByName(pipe,"Lower End Bottom Elevation");

//Get location of hanger
hloc=Revit.Elements.Element.GetLocation(hanger);
//Set elevation of point to 0
locx=Autodesk.DesignScript.Geometry.Point.X(hloc);
locy=Autodesk.DesignScript.Geometry.Point.Y(hloc);
hangloc=Autodesk.DesignScript.Geometry.Point.ByCoordinates(locx,locy,0);
//Get distance from pipe start to hanger location
dist=Autodesk.DesignScript.Geometry.DistanceTo(hangloc,pipeloc);
//Find BOP at hanger location
BOP=(slope*dist)/12+pbottom;
//Find center of Pipe at hanger location
CL=(slope*dist)/12+lowend;
//Round to 1/8"
bottomrnd = DSCore.Math.Round(BOP*(12*8))/(12*8);

//Get System Abbreviation
abb=Revit.Elements.Element.GetParameterValueByName(pipe,"System Abbreviation");
//Get Pipe Size
pSize=Revit.Elements.Element.GetParameterValueByName(pipe,"Diameter")/12;
//Get Insulation Thickness
pIns=Revit.Elements.Element.GetParameterValueByName(pipe,"Insulation Thickness")/12;
boi=bottomrnd-pIns;
Pid=Revit.Elements.Element.Id(pipe);
Hsizerough=pSize+2*pIns-0.0625;
rodDia=pSize<=4?0.375:pSize<=8?0.5:pSize<=16?0.625:pSize<=20?0.75:1;
# ----------------------------------------
set_hanger_properties_and_reset = CodeBlock(hangers=code_block_10.hanger, bops=code_block_10.bottomrnd, systems=code_block_10.abb, sizes=code_block_10.pSize, ins=code_block_10.pIns, bois=code_block_10.boi, IDs=code_block_10.Pid, pipes=change_pipe_ref_level_to_match.pipes, levels=change_pipe_ref_level_to_match.piperefLevel)  # "Set Hanger Properties AND Reset Pipe Ref Level to Orig Value"
# ---------- set_hanger_properties_and_reset.designscript (8 lines) ----------
//Revit.Elements.Element.SetParameterByName(hangers,"Mark","H-"+[1..DSCore.List.Count(hangers)]);
Revit.Elements.Element.SetParameterByName(hangers,"BOP",bops);
Revit.Elements.Element.SetParameterByName(hangers,"Support Discipline",systems);
Revit.Elements.Element.SetParameterByName(hangers,"QTC Pipe Size",sizes);
Revit.Elements.Element.SetParameterByName(hangers,"QTC Insulation Thickness",ins);
Revit.Elements.Element.SetParameterByName(hangers,"BOI",bois);
Revit.Elements.Element.SetParameterByName(hangers,"QTC Pipe ID",IDs);
Revit.Elements.Element.SetParameterByName(pipes,"Reference Level",levels);
# ----------------------------------------

# group: Report Hanger Levels
boolean = BoolSelector(true)
groupByKey = List.GroupByKey(list=change_pipe_ref_level_to_match.hngrefLevel, keys=change_pipe_ref_level_to_match.hngrefLevel)
string_from_object = FromObject(obj=groupByKey.uniqueKeys)
python_script = Python(IN[0]=boolean, IN[1]=string_from_object)  # CPython3; starter script, not edited (OUT = 0)
