# Dynamo graph Hanger - Update Elevation R23_script.dyn (Dynamo 2.19.3.6394)
# packages: bimorphNodes 5.1.3

# group: All Pipe Accessories
categories = Categories("OST_PipeAccessory")
current = Document.Current()
activeView = Document.ActiveView(document=current)
all_elements_of_category_in_view = ElementsOfCategoryInView(Category=categories, View=activeView)

# group: Filter down to hangers with the 4 shared parameters used
code_block = CodeBlock(list=all_elements_of_category_in_view)
# ---------- code_block.designscript (5 lines) ----------
ins=Revit.Elements.Element.GetParameterValueByName(list,"QTC Insulation Thickness");
psize=Revit.Elements.Element.GetParameterValueByName(list,"QTC Pipe Size");
bop=Revit.Elements.Element.GetParameterValueByName(list,"BOP");
boi=Revit.Elements.Element.GetParameterValueByName(list,"BOI");
test = ins>=0 && psize>=0 && bop>=0 && boi>=0;
# ----------------------------------------
code_block_2 = CodeBlock { false; }
isNull = Object.IsNull()  # unwired: object
replaceByCondition = Replace(item=code_block.test, replaceWith=code_block_2, condition=isNull)
filterByBoolMask = List.FilterByBoolMask(list=all_elements_of_category_in_view, mask=replaceByCondition)

# group: Create Hanger interferance solid
getLocation = Element.GetLocation(element=filterByBoolMask.in)
code_block_3 = CodeBlock { "Diameter"; }
getParameterValueByName = Element.GetParameterValueByName(element=filterByBoolMask.in, parameterName=code_block_3)
code_block_4 = CodeBlock(dia=getParameterValueByName) { rad = (dia+1.5) /(2*12); }
byCenterPointRadius = Sphere.ByCenterPointRadius(centerPoint=getLocation, radius=code_block_4)

# group: Get all pipes in view
categories_2 = Categories("OST_PipeCurves")
all_elements_of_category_in_view_2 = ElementsOfCategoryInView(Category=categories_2, View=activeView)

intersectsSolid = Revit.Element.IntersectsSolid(solids=byCenterPointRadius, elements=all_elements_of_category_in_view_2)
intersectingElements = Results.SolidIntersectionResult.IntersectingElements(solidIntersectionResult=intersectsSolid)
count = List.Count(list=intersectingElements@L2)
code_block_5 = CodeBlock(ints=count) { multipipe = ints > 1; nopipe = ints < 1; multipipe||nopipe; }
filterByBoolMask_2 = List.FilterByBoolMask(list=filterByBoolMask.in, mask=code_block_5.nopipe)
code_block_6 = CodeBlock(element=filterByBoolMask_2.in) { name=Revit.Elements.Element.Name(element); id=Revit.Elements.Element.Id(element); name+" - " +id; }
hangers_intersecting_no_pipes = Watch(code_block_6.out2)  # graph output
filterByBoolMask_3 = List.FilterByBoolMask(list=filterByBoolMask.in, mask=code_block_5.multipipe)
code_block_7 = CodeBlock(element=filterByBoolMask_3.in) { name=Revit.Elements.Element.Name(element); id=Revit.Elements.Element.Id(element); name+" - " +id; }
hangers_intersecting_multiple = Watch(code_block_7.out2)  # "Hangers Intersecting Multiple Pipes"; graph output
all_elements_in_active_view = ElementsInView()
reset_overrides = Python(IN[0]=all_elements_in_active_view, IN[1]=activeView)  # CPython3
# ---------- reset_overrides.python (28 lines) ----------
import clr
clr.AddReference('RevitAPI')
from Autodesk.Revit.DB import *

clr.AddReference("RevitNodes")
import Revit
clr.ImportExtensions(Revit.Elements)

clr.AddReference("RevitServices")
import RevitServices
from RevitServices.Persistence import DocumentManager
from RevitServices.Transactions import TransactionManager

doc = DocumentManager.Instance.CurrentDBDocument
items = UnwrapElement(IN[0])
view = UnwrapElement(IN[1])
booleans = []

override = OverrideGraphicSettings()

TransactionManager.Instance.EnsureInTransaction(doc)
for item in items:
	try:
		view.SetElementOverrides(item.Id, override)
		booleans.append(True)
	except: booleans.append(False)
TransactionManager.Instance.TransactionTaskDone()
OUT = (items,view,booleans)
# ----------------------------------------
filterByBoolMask_4 = List.FilterByBoolMask(list=filterByBoolMask.in, mask=code_block_5.out2)
count_2 = List.Count(list=filterByBoolMask_4.in)
code_block_8 = CodeBlock(cnt=count_2) { cnt>0; }
code_block_9 = CodeBlock(test=code_block_8, TrueList=all_elements_in_active_view) { indx = test ? 0 : 1; valueSet = [ TrueList, "Empty" ] [ indx ]; }

# group: View Overrides
color_palette = ColorPalette({R: 192, G: 192, B: 192, A: 255})
fill_patterns = FillPatterns()  # nothing selected
code_block_10 = CodeBlock { 50; }
byProperties = Revit.Filter.OverrideGraphicSettings.ByProperties(cutFillColor=color_palette, projectionFillColor=color_palette, cutLineColor=color_palette, projectionLineColor=color_palette, cutFillPattern=fill_patterns, projectionFillPattern=fill_patterns, transparency=code_block_10)

overrideInView = Element.OverrideInView(element=code_block_9.valueSet, overrides=byProperties)
code_block_11 = CodeBlock(waitfor2=reset_overrides, waitfor=overrideInView, pass=filterByBoolMask_4.in) { waitfor2; waitfor; pass; }
color_palette_2 = ColorPalette({R: 255, G: 69, B: 0, A: 255})
overrideColorInView = Element.OverrideColorInView(element=code_block_11.waitfor, color=color_palette_2)

# group: Get intersecting pipe
firstItem = List.FirstItem(list=intersectingElements@L2)

code_block_12 = CodeBlock(hanger=filterByBoolMask.in, pipe=firstItem)
# ---------- code_block_12.designscript (30 lines) ----------
hanger;
//Find location of the low end of the pipe
loc=Revit.Elements.Element.GetLocation(pipe);
start=Autodesk.DesignScript.Geometry.Curve.StartPoint(loc);
startz=Autodesk.DesignScript.Geometry.Point.Z(start);
end=Autodesk.DesignScript.Geometry.Curve.EndPoint(loc);
endz=Autodesk.DesignScript.Geometry.Point.Z(end);
lowend=startz<endz?start:end;
//Set elevation of point to 0
lowendx=Autodesk.DesignScript.Geometry.Point.X(lowend);
lowendy=Autodesk.DesignScript.Geometry.Point.Y(lowend);
pipeloc=Autodesk.DesignScript.Geometry.Point.ByCoordinates(lowendx,lowendy,0);
//Get pipe slope
slope=Revit.Elements.Element.GetParameterValueByName(pipe,"Slope");
//Get pipe Bottom Elevation
pbottom=Revit.Elements.Element.GetParameterValueByName(pipe,"Lower End Bottom Elevation");

//Get location of hanger
hloc=Revit.Elements.Element.GetLocation(hanger);
//Set elevation of point to 0
locx=Autodesk.DesignScript.Geometry.Point.X(hloc);
locy=Autodesk.DesignScript.Geometry.Point.Y(hloc);
hangloc=Autodesk.DesignScript.Geometry.Point.ByCoordinates(locx,locy,0);
//Get distance from pipe start to hanger location
dist=Autodesk.DesignScript.Geometry.DistanceTo(hangloc,pipeloc);
//Find BOP at hanger location
BOP=(slope*dist)/12+pbottom;
//Find center of Pipe at hanger location
OD = Revit.Elements.Element.GetParameterValueByName(pipe,"Outside Diameter");
CL=BOP+OD/2/12;
# ----------------------------------------
code_block_13 = CodeBlock { "Elevation from Level"; }
setParameterByName = Element.SetParameterByName(element=code_block_12.hanger, parameterName=code_block_13, value=code_block_12.CL)
watch = Watch(code_block_12.CL)
watch_2 = Watch(code_block_12.OD)
