# Dynamo graph Points_from_csv_Survey_Point_script.dyn (Dynamo 2.16.2.5624)

# group: Get Excel data
code_block = CodeBlock { "Point File Path"; }
findByName = GlobalParameter.FindByName(name=code_block)
value = GlobalParameter.Value(globalParameter=findByName)
importCSV = Data.ImportCSV(filePath=value)
code_block_2 = CodeBlock(list=importCSV) { list; tlist=DSCore.List.Transpose(list); dlist=DSCore.List.DropItems(tlist,1); rlist=DSCore.List.Transpose(dlist); }

# group: Get elevation of current view level
categories = Categories("OST_Levels")
all_elements_of_category = ElementsOfCategory(Category=categories)
name = Level.Name(level=all_elements_of_category)
current = Document.Current()
activeView = Document.ActiveView(document=current)
code_block_3 = CodeBlock { "Associated Level"; }
getParameterValueByName = Element.GetParameterValueByName(element=activeView, parameterName=code_block_3)
eq = name == getParameterValueByName
filterByBoolMask = List.FilterByBoolMask(list=all_elements_of_category, mask=eq)
elevation = Level.Elevation(level=filterByBoolMask.in)

# group: Get X, Y, Z Coordinates
extract_x_and_y_coodinates = CodeBlock(list=code_block_2.rlist, levelZ=elevation)
# ---------- extract_x_and_y_coodinates.designscript (7 lines) ----------
pointName=DSCore.List.GetItemAtIndex(list,0);
comment=DSCore.List.GetItemAtIndex(list,4);
//description=DSCore.List.GetItemAtIndex(list,5);
xCoord=DSCore.List.GetItemAtIndex(list,1);
yCoord=DSCore.List.GetItemAtIndex(list,2);
num = DSCore.List.Count(xCoord);
zCoord=DSCore.List.OfRepeatedItem(levelZ,num);
# ----------------------------------------
byCoordinates = Point.ByCoordinates(x=extract_x_and_y_coodinates.xCoord, y=extract_x_and_y_coodinates.yCoord, z=extract_x_and_y_coodinates.zCoord)

# group: Rotate Points to True North
origin = Point.Origin()
byTwoPoints = Vector.ByTwoPoints(start=origin, end=byCoordinates)
XY = Plane.XY()
categories_2 = Categories("OST_ProjectBasePoint")
all_elements_of_category_2 = ElementsOfCategory(Category=categories_2)
code_block_4 = CodeBlock { "Angle to True North"; }
getParameterValueByName_2 = Element.GetParameterValueByName(element=all_elements_of_category_2, parameterName=code_block_4)
rotate = Vector.Rotate(vector=byTwoPoints@L1, plane=XY, degrees=getParameterValueByName_2)
asPoint = Vector.AsPoint(vector=rotate)

# group: Translate to Survey Point Base
origin_2 = Point.Origin()
surveyPoint = Coordinates.SurveyPoint()
byTwoPoints_2 = Vector.ByTwoPoints(start=origin_2, end=surveyPoint)
translate = Geometry.Translate(geometry=asPoint, direction=byTwoPoints_2)
code_block_5 = CodeBlock { 1; }
flatten = List.Flatten(list=translate, amount=code_block_5)

# group: Create Points
select_family_to_place = FamilyTypes("SSW Control Point:Control Point")  # graph input
place_family_instance_by_point = Python(IN[0]=flatten, IN[1]=select_family_to_place)  # "Place Family Instance By Point in Transaction"; CPython3
# ---------- place_family_instance_by_point.python (33 lines) ----------
import clr
clr.AddReference('RevitAPI')
from Autodesk.Revit.DB import *

clr.AddReference("RevitNodes")
import Revit
clr.ImportExtensions(Revit.Elements)
clr.ImportExtensions(Revit.GeometryConversion)

clr.AddReference("RevitServices")
import RevitServices
from RevitServices.Persistence import DocumentManager
from RevitServices.Transactions import TransactionManager
from Autodesk.Revit.DB.Structure import *

doc = DocumentManager.Instance.CurrentDBDocument
points = UnwrapElement(IN[0])
famtype = UnwrapElement(IN[1])

elementlist = list()

ST = StructuralType.NonStructural

TransactionManager.Instance.EnsureInTransaction(doc)
# Make sure the familysymbol is active
if famtype.IsActive == False:
	famtype.Activate()
	doc.Regenerate()
for point in points:
	newobj = doc.Create.NewFamilyInstance(point.ToXyz(),famtype,ST)
	elementlist.append(newobj)
TransactionManager.Instance.TransactionTaskDone()
OUT = elementlist
# ----------------------------------------

code_block_6 = CodeBlock { "Mark"; "Comments"; "Alternate Description"; }

# group: Make sure the values are strings
string_from_object = FromObject(object=extract_x_and_y_coodinates.pointName)
string_from_object_2 = FromObject(object=extract_x_and_y_coodinates.comment)

setParameterByName = Element.SetParameterByName(element=place_family_instance_by_point, parameterName=code_block_6.out0, value=string_from_object)
setParameterByName_2 = Element.SetParameterByName(element=place_family_instance_by_point, parameterName=code_block_6.out1, value=string_from_object_2)
