# Dynamo graph Points_from_csv_script.dyn "Points from csv" (Dynamo 2.16.2.5624)

python_script = Python()  # CPython3; unwired: IN[0]
# ---------- python_script.python (83 lines) ----------
import csv
import os
from pyrevit import forms
from Autodesk.Revit.DB import FilteredElementCollector, FamilyInstance, XYZ, Transaction, BuiltInCategory

# Prompt user to select a CSV file
file_path = forms.pick_file(file_ext='csv', files_filter="CSV files (*.csv)|*.csv", multi_file=False)
if not file_path or not os.path.exists(file_path):
    forms.alert('No file selected or file does not exist.', exitscript=True)

# Read data from CSV file (mark, x, y, z, comments)
data = []
with open(file_path, 'r') as csvfile:
    csvreader = csv.reader(csvfile)
    for row in csvreader:
        try:
            # Expecting the format: mark, X, Y, Z, comments
            mark = row[0]
            x = float(row[1])
            y = float(row[2])
            z = float(row[3])
            comments = row[4]
            # Store the data as a tuple with mark, XYZ object, and comments
            data.append((mark, x, y, z, comments))
        except (ValueError, IndexError):
            forms.alert('Invalid CSV format. Ensure it contains mark, X, Y, Z, and comments.', exitscript=True)

# Get current Revit document
doc = __revit__.ActiveUIDocument.Document

# Collect all loaded family symbols from the project
family_collector = FilteredElementCollector(doc).OfClass(FamilyInstance)

# Create a dictionary of family symbols for user selection
family_symbols = {}
for family_instance in family_collector:
    family_symbols[family_instance.Symbol.Family.Name + " - " + family_instance.Symbol.Name] = family_instance.Symbol

if not family_symbols:
    forms.alert("No family symbols found in the project.", exitscript=True)

# Prompt user to select a family symbol
selected_family_name = forms.SelectFromList.show(list(family_symbols.keys()), title='Select Family Symbol', button_name='Select')
if not selected_family_name:
    forms.alert('No family symbol selected.', exitscript=True)

selected_family_symbol = family_symbols[selected_family_name]

# Ensure that the family symbol is activated
if not selected_family_symbol.IsActive:
    t_activate = Transaction(doc, 'Activate Family Symbol')
    t_activate.Start()
    selected_family_symbol.Activate()
    t_activate.Commit()

# Start transaction to place instances of family symbol at each coordinate and set mark and comments
t = Transaction(doc, 'Place Family Instances from CSV')
t.Start()

try:
    for mark, x, y, z, comments in data:
        # Create the XYZ object from x, y, z coordinates
        coord = XYZ(x, y, z)
        
        # Place the family instance at the given coordinate (XYZ object)
        family_instance = doc.Create.NewFamilyInstance(coord, selected_family_symbol, doc.ActiveView)
        
        # Set the "Mark" and "Comments" parameters
        mark_param = family_instance.LookupParameter('Mark')
        comments_param = family_instance.LookupParameter('Comments')
        
        if mark_param and mark:
            mark_param.Set(mark)
        
        if comments_param and comments:
            comments_param.Set(comments)
    
    t.Commit()
    forms.alert('Family instances placed successfully with Mark and Comments!')

except Exception as e:
    t.RollBack()
    forms.alert('Error placing family instances: {}'.format(str(e)), exitscript=True)
# ----------------------------------------
