# Dynamo graph PointsoverFittings3.3.dyn "PointsoverFittings3.3_script" (Dynamo 2.13.1.3887)

# group: Collect Pipe Fittings in Current View
code_block = CodeBlock { Category.ByName("Pipe Fittings"); }
current = Document.Current()
activeView = Document.ActiveView(document=current)
all_elements_of_category_in_view = ElementsOfCategoryInView(Category=code_block, View=activeView)

# group: Filter Down to Elbows and Tees
get_fitting_part_type = Python(IN[0]=all_elements_of_category_in_view)  # CPython3
# ---------- get_fitting_part_type.python (15 lines) ----------
# Load the Python Standard and DesignScript Libraries
import sys
import clr
clr.AddReference('ProtoGeometry')
from Autodesk.DesignScript.Geometry import *

#The inputs to this node will be stored as a list in the IN variables.
fittings = UnwrapElement(IN[0])
listout = []

for x in fittings:
	listout.append(x.MEPModel.PartType)

#Assign your output to the OUT variable.
OUT = listout
# ----------------------------------------
string_from_object = FromObject(obj=get_fitting_part_type)
code_block_2 = CodeBlock(ftg=string_from_object) { tee=ftg=="Tee"; elbow=ftg=="Elbow"; wye=ftg=="Wye"; cross=ftg=="Cross"; tee||elbow||wye||cross; }
filterByBoolMask = List.FilterByBoolMask(list=all_elements_of_category_in_view, mask=code_block_2.out4)

# group: Get Coordinates
code_block_3 = CodeBlock(element=filterByBoolMask.in) { coords=Elements.View3D.GetLocation(element); List.Flatten(coords,2); }

# group: Round to 1/8" and create key for unique x-y
X = Point.X(point=code_block_3.out1)
Y = Point.Y(point=code_block_3.out1)
code_block_4 = CodeBlock(x=X, y=Y) { xr=Math.Round(x*12*8); yr=Math.Round(y*12*8); coordstr=xr+"str"+yr; }

string_from_object_2 = FromObject(obj=code_block_4.coordstr)

# group: Get System Type of Fitting
code_block_5 = CodeBlock(list=filterByBoolMask.in) { systyp=Elements.Element.GetParameterValueByName(list,"System Type"); }
name = Element.Name(element=code_block_5)

add_system_type_to_key = CodeBlock(Coord=string_from_object_2, SysType=name) { break_char=","; key=Coord+break_char+SysType; }

# group: Get one Point for Each Unique X-Y+ System Type
groupByKey = List.GroupByKey(list=code_block_3.out1, keys=add_system_type_to_key.key)
firstItem = List.FirstItem(list=groupByKey.groups@L2)
code_block_6 = CodeBlock { 1; }
flatten = List.Flatten(list=firstItem, amount=code_block_6)

# group: Create Points and choose family to place
select_family_to_place = FamilyTypes("SSW Layout Point:Control Point")
place_family_instance_by_point = Python(IN[0]=flatten, IN[1]=select_family_to_place)  # "Place Family Instance By Point in Transaction"; CPython3
# ---------- place_family_instance_by_point.python (33 lines) ----------
import clr
clr.AddReference('RevitAPI')
from Autodesk.Revit.DB import *

clr.AddReference("RevitNodes")
import Revit
clr.ImportExtensions(Revit.Elements)
clr.ImportExtensions(Revit.GeometryConversion)

clr.AddReference("RevitServices")
import RevitServices
from RevitServices.Persistence import DocumentManager
from RevitServices.Transactions import TransactionManager
from Autodesk.Revit.DB.Structure import *

doc = DocumentManager.Instance.CurrentDBDocument
points = UnwrapElement(IN[0])
famtype = UnwrapElement(IN[1])

elementlist = list()

ST = StructuralType.NonStructural

TransactionManager.Instance.EnsureInTransaction(doc)
# Make sure the familysymbol is active
if famtype.IsActive == False:
	famtype.Activate()
	doc.Regenerate()
for point in points:
	newobj = doc.Create.NewFamilyInstance(point.ToXyz(),famtype,ST)
	elementlist.append(newobj)
TransactionManager.Instance.TransactionTaskDone()
OUT = elementlist
# ----------------------------------------

# group: Get System Type From Unique Key
indexOf = String.IndexOf(string=groupByKey.uniqueKeys, searchFor=add_system_type_to_key.break_char)
code_block_7 = CodeBlock(list=groupByKey.uniqueKeys, index=indexOf) { str_len=String.Length(list); char_to_delete=str_len-index; String.Remove(list,0,index+1); }

# group: Put System Type in Comments
code_block_8 = CodeBlock { "Comments"; }
setParameterByName = Element.SetParameterByName(element=place_family_instance_by_point, parameterName=code_block_8, value=code_block_7.out2)

# group: Get Sequence and Create Point Name
point_name_prefix = StringInput("RP")
starting_number = DoubleInput(1)
count = List.Count(list=setParameterByName)
code_block_9 = CodeBlock { 1; }
sequence = Sequence(start=starting_number, amount=count, step=code_block_9)
add = point_name_prefix + sequence

# group: Apply Point Name
code_block_10 = CodeBlock { "Mark"; }
setParameterByName_2 = Element.SetParameterByName(element=setParameterByName, parameterName=code_block_10, value=add)

# group: Output
points_placed = Watch(count)  # graph output

# group: Output
lastItem = List.LastItem(list=add)
last_point_name = Watch(lastItem)  # graph output
