# Dynamo graph PointsOverVerticalPipes_script.dyn (Dynamo 2.12.1.8246)

# group: Get Pipes in Active View
categories = Categories("OST_PipeCurves")
current = Document.Current()
activeView = Document.ActiveView(document=current)
all_elements_of_category_in_view = ElementsOfCategoryInView(Category=categories, View=activeView)

# group: Get Pipes with slope over 8
code_block = CodeBlock { "Slope"; }
getParameterValueByName = Element.GetParameterValueByName(element=all_elements_of_category_in_view, parameterName=code_block)
code_block_2 = CodeBlock { 8; }
gt = getParameterValueByName > code_block_2
code_block_3 = CodeBlock { true; }
isNull = Object.IsNull()  # unwired: object
replaceByCondition = Replace(item=gt, replaceWith=code_block_3, condition=isNull)
filterByBoolMask = List.FilterByBoolMask(list=all_elements_of_category_in_view, mask=replaceByCondition)

# group: Get Coordinates
code_block_4 = CodeBlock(element=filterByBoolMask.in) { coords=Elements.View3D.GetLocation(element); List.Flatten(coords,2); }

startPoint = Curve.StartPoint(curve=code_block_4.out1)

# group: Round to 1/8" and create key for unique x-y
X = Point.X(point=startPoint)
Y = Point.Y(point=startPoint)
code_block_5 = CodeBlock(x=X, y=Y) { xr=Math.Round(x*12*8); yr=Math.Round(y*12*8); coordstr=xr+"str"+yr; }

string_from_object = FromObject(obj=code_block_5.coordstr)
add_system_type_to_key = CodeBlock(Coord=string_from_object) { break_char=","; key=Coord+break_char; }

# group: Get one Point for Each Unique X-Y+ System Type
groupByKey = List.GroupByKey(list=startPoint, keys=add_system_type_to_key.key)
firstItem = List.FirstItem(list=groupByKey.groups@L2)
code_block_6 = CodeBlock { 1; }
flatten = List.Flatten(list=firstItem, amount=code_block_6)

# group: Create Points and choose family to place
select_family_to_place = FamilyTypes("SSW Layout Point:Control Point")
place_family_instance_by_point = Python(IN[0]=flatten, IN[1]=select_family_to_place)  # "Place Family Instance By Point in Transaction"; CPython3
# ---------- place_family_instance_by_point.python (33 lines) ----------
import clr
clr.AddReference('RevitAPI')
from Autodesk.Revit.DB import *

clr.AddReference("RevitNodes")
import Revit
clr.ImportExtensions(Revit.Elements)
clr.ImportExtensions(Revit.GeometryConversion)

clr.AddReference("RevitServices")
import RevitServices
from RevitServices.Persistence import DocumentManager
from RevitServices.Transactions import TransactionManager
from Autodesk.Revit.DB.Structure import *

doc = DocumentManager.Instance.CurrentDBDocument
points = UnwrapElement(IN[0])
famtype = UnwrapElement(IN[1])

elementlist = list()

ST = StructuralType.NonStructural

TransactionManager.Instance.EnsureInTransaction(doc)
# Make sure the familysymbol is active
if famtype.IsActive == False:
	famtype.Activate()
	doc.Regenerate()
for point in points:
	newobj = doc.Create.NewFamilyInstance(point.ToXyz(),famtype,ST)
	elementlist.append(newobj)
TransactionManager.Instance.TransactionTaskDone()
OUT = elementlist
# ----------------------------------------

# group: Get EC Points
categories_2 = Categories("OST_PipeAccessory")
all_elements_of_category = ElementsOfCategory(Category=categories_2)
name = Family.Name(family=all_elements_of_category)
code_block_7 = CodeBlock { "Point"; true; "EC"; }
contains = String.Contains(string=name, searchFor=code_block_7.out0, ignoreCase=code_block_7.out1)
code_block_8 = CodeBlock { "Mark"; }
getParameterValueByName_2 = Element.GetParameterValueByName(element=all_elements_of_category, parameterName=code_block_8)
startsWith = String.StartsWith(string=getParameterValueByName_2, searchFor=code_block_7.out2, ignoreCase=code_block_7.out1)
code_block_9 = CodeBlock(point=contains, ec=startsWith) { point&&ec; }
filterByBoolMask_2 = List.FilterByBoolMask(list=all_elements_of_category, mask=code_block_9)

# group: Get EC Point Numbers
code_block_10 = CodeBlock { "Mark"; }
getParameterValueByName_3 = Element.GetParameterValueByName(element=filterByBoolMask_2.in, parameterName=code_block_10)
length = String.Length(string=getParameterValueByName_3)
code_block_11 = CodeBlock(lngth=length) { 2; lngth-2; }
substring = String.Substring(string=getParameterValueByName_3, startIndex=code_block_11.out0, length=code_block_11.out1)
toNumber = String.ToNumber(string=substring)

# group: Get Sarting Number
maximumItem = List.MaximumItem(list=toNumber)
code_block_12 = CodeBlock { 0; }
isNull_2 = Object.IsNull()  # unwired: object
replaceByCondition_2 = Replace(item=maximumItem, replaceWith=code_block_12, condition=isNull_2)
code_block_13 = CodeBlock(max=replaceByCondition_2) { max+1; }

# group: Get Sequence and Create Point Name
count = List.Count(list=place_family_instance_by_point)
point_name_prefix = StringInput("EC")
code_block_14 = CodeBlock { 1; }
sequence = Sequence(start=code_block_13, amount=count, step=code_block_14)

# group: Output
points_placed = Watch(count)  # graph output

floor = Math.Floor(number=sequence)

# group (continued): Get Sequence and Create Point Name
add = point_name_prefix + floor

# group: Output
lastItem = List.LastItem(list=add)
last_point_name = Watch(lastItem)  # graph output

# group: Apply Point Name
code_block_15 = CodeBlock { "Mark"; }
setParameterByName = Element.SetParameterByName(element=place_family_instance_by_point, parameterName=code_block_15, value=add)

# group: Apply Point Name
code_block_16 = CodeBlock { "Comments"; "ElevationChange"; }
setParameterByName_2 = Element.SetParameterByName(element=setParameterByName, parameterName=code_block_16.out0, value=code_block_16.out1)
