# Dynamo graph Apply Std Rod Dia_script.dyn (Dynamo 2.16.2.5624)

categories = Categories("OST_PipeAccessory")
current = Document.Current()
activeView = Document.ActiveView(document=current)
all_elements_of_category_in_view = ElementsOfCategoryInView(Category=categories, View=activeView)
code_block = CodeBlock { "QTC Pipe Size"; }
getParameterValueByName = Element.GetParameterValueByName(element=all_elements_of_category_in_view, parameterName=code_block)
code_block_2 = CodeBlock { 0; }
gt = getParameterValueByName > code_block_2
code_block_3 = CodeBlock { false; }
isNull = Object.IsNull()  # unwired: object
replaceByCondition = Replace(item=gt, replaceWith=code_block_3, condition=isNull)
filterByBoolMask = List.FilterByBoolMask(list=all_elements_of_category_in_view, mask=replaceByCondition)
code_block_4 = CodeBlock { "Rod Diameter"; }
code_block_5 = CodeBlock { "QTC Pipe Size"; }
getParameterValueByName_2 = Element.GetParameterValueByName(element=filterByBoolMask.in, parameterName=code_block_5)
code_block_6 = CodeBlock(ft=getParameterValueByName_2) { inches=ft*12; }
code_block_7 = CodeBlock { 0.375; 5; 0.5; 10; 0.625; }
apply_rod_dia_logic = CodeBlock(size=code_block_6, rodsize1=code_block_7.out0, psize2=code_block_7.out1, rodsize2=code_block_7.out2, psize3=code_block_7.out3, rodsize3=code_block_7.out4)
# ---------- apply_rod_dia_logic.designscript (9 lines) ----------
size;
rodsize1;
psize2;
rodsize2;
psize3;
rodsize3;
size1test=size<psize2||psize2==0;
size3test=size>=(psize3-0.01)&&psize3>0;
rodsize=size>0?(size1test?rodsize1:size3test?rodsize3:rodsize2):0;
# ----------------------------------------
setParameterByName = Element.SetParameterByName(element=filterByBoolMask.in, parameterName=code_block_4, value=apply_rod_dia_logic.rodsize)
