# Dynamo graph IsolateSystemandHangers1.1.dyn "IsolateSystemandHangers1.1_script" (Dynamo 2.19.3.6394)

code_block = CodeBlock()
# ---------- code_block.designscript (4 lines) ----------
Category.ByName("Pipes");
Category.ByName("Pipe Fittings");
Category.ByName("Pipe Accessories");
Category.ByName("Plumbing Fixtures");
# ----------------------------------------
current = Document.Current()
activeView = Document.ActiveView(document=current)
all_elements_of_category_in_view = ElementsOfCategoryInView(Category=code_block.out0, View=activeView)
all_elements_of_category_in_view_2 = ElementsOfCategoryInView(Category=code_block.out1, View=activeView)
all_elements_of_category_in_view_3 = ElementsOfCategoryInView(Category=code_block.out2, View=activeView)
all_elements_of_category_in_view_4 = ElementsOfCategoryInView(Category=code_block.out3, View=activeView)
list_create = List.Create(item0=all_elements_of_category_in_view, item1=all_elements_of_category_in_view_2, item2=all_elements_of_category_in_view_3, item3=all_elements_of_category_in_view_4)
code_block_2 = CodeBlock(list=list_create) { l1=DSCore.List.Flatten(list,1); comms=Revit.Elements.Element.GetParameterValueByName(l1,"Support Discipline"); }

# group: Get Current Selection
python_script = Python()  # CPython3; unwired: IN[0]
# ---------- python_script.python (21 lines) ----------
#Copyright(c) 2016, Dimitar Venkov
# @5devene, dimitar.ven@gmail.com

import clr

clr.AddReference("RevitNodes")
import Revit
clr.ImportExtensions(Revit.Elements)

clr.AddReference("RevitServices")
import RevitServices
from RevitServices.Persistence import DocumentManager
doc = DocumentManager.Instance.CurrentDBDocument
uidoc = DocumentManager.Instance.CurrentUIApplication.ActiveUIDocument

def output1(l1):
	if len(l1) == 1: return l1[0]
	else: return l1

selid = uidoc.Selection.GetElementIds()
OUT = output1([doc.GetElement(id).ToDSType(True) for id in selid])
# ----------------------------------------

code_block_3 = CodeBlock(alllist=code_block_2.l1, sellist=python_script)
# ---------- code_block_3.designscript (4 lines) ----------
l1=Revit.Elements.Element.GetParameterValueByName(alllist,"System Type");
Revit.Elements.Element.GetParameterValueByName(l1,"Abbreviation");
l2=Revit.Elements.Element.GetParameterValueByName(sellist,"System Type");
Revit.Elements.Element.GetParameterValueByName(l2,"Abbreviation");
# ----------------------------------------

# group: Filter Elements in View that Match System Type
groupByKey = List.GroupByKey(list=code_block_3.out3, keys=code_block_3.out3)
eq = code_block_3.out1 == groupByKey.uniqueKeys  # lacing=CrossProduct
if_any_true = Python(IN[0]=eq)  # CPython3
# ---------- if_any_true.python (15 lines) ----------
# Load the Python Standard and DesignScript Libraries
import sys
import clr
clr.AddReference('ProtoGeometry')
from Autodesk.DesignScript.Geometry import *

# The inputs to this node will be stored as a list in the IN variables.
list = IN[0]
out = []
for sublist in list:
	if True in sublist:
		out.append(True)
	else:
		out.append(False)
OUT = out
# ----------------------------------------
filterByBoolMask = List.FilterByBoolMask(list=code_block_2.l1, mask=if_any_true)

# group: Get System Abbreviation of selected elements
element_types = ElementTypes("PipingSystemType")
all_elements_of_type = ElementsOfType(element_type=element_types)
code_block_4 = CodeBlock(list=all_elements_of_type)
# ---------- code_block_4.designscript (2 lines) ----------
l1=Revit.Elements.Element.
GetParameterValueByName(list,"Abbreviation");
# ----------------------------------------
eq_2 = code_block_4 == code_block_3.out3  # lacing=CrossProduct
if_any_true_2 = Python(IN[0]=eq_2)  # CPython3
# ---------- if_any_true_2.python (17 lines) ----------
# Load the Python Standard and DesignScript Libraries
import sys
import clr
clr.AddReference('ProtoGeometry')
from Autodesk.DesignScript.Geometry import *

# The inputs to this node will be stored as a list in the IN variables.
input_list = IN[0]
out = []

for item in input_list:
    if isinstance(item, list):  # If item is a sublist
        out.append(True in item)
    else:  # If item is a single boolean
        out.append(bool(item))

OUT = out
# ----------------------------------------
test_if_then = Python(IN[0]=python_script, IN[1]=if_any_true_2, IN[2]=eq_2)  # CPython3
# ---------- test_if_then.python (21 lines) ----------
import clr
clr.AddReference('RevitServices')
from RevitServices.Persistence import DocumentManager
from RevitServices.Transactions import TransactionManager

clr.AddReference("RevitNodes")
import Revit
clr.ImportExtensions(Revit.Elements)

# Unwrap elements if needed
input0 = UnwrapElement(IN[0]) if IN[0] is not None else None
input1 = UnwrapElement(IN[1]) if IN[1] is not None else None
input2 = UnwrapElement(IN[2]) if IN[2] is not None else None

try:
    if input0 is not None and input0 > 1:
        OUT = input1
    else:
        OUT = input2
except Exception as e:
    OUT = "Error: {}".format(str(e))
# ----------------------------------------
filterByBoolMask_2 = List.FilterByBoolMask(list=all_elements_of_type, mask=test_if_then)
code_block_5 = CodeBlock(list=filterByBoolMask_2.in) { l1=Revit.Elements.Element.GetParameterValueByName(list,"Abbreviation"); }

# group: Filter Elements in View Where Comments Match system Abbreviation
groupByKey_2 = List.GroupByKey(list=code_block_5, keys=code_block_5)
eq_3 = code_block_2.comms == groupByKey_2.uniqueKeys  # lacing=CrossProduct
if_any_true_3 = Python(IN[0]=eq_3)  # CPython3; same code as if_any_true
filterByBoolMask_3 = List.FilterByBoolMask(list=code_block_2.l1, mask=if_any_true_3)

# group: Isolate Elements in View
list_create_2 = List.Create(item0=filterByBoolMask.in, item1=filterByBoolMask_3.in)
code_block_6 = CodeBlock(list=list_create_2) { DSCore.List.Flatten(list,1); }
current_2 = Document.Current()
activeView_2 = Document.ActiveView(document=current_2)
isolate_selected_elements = Python(IN[0]=code_block_6, IN[1]=activeView_2)  # CPython3
# ---------- isolate_selected_elements.python (27 lines) ----------
import clr
clr.AddReference('RevitAPI')
from Autodesk.Revit.DB import *
from System.Collections.Generic import *

clr.AddReference("RevitServices")
import RevitServices
from RevitServices.Persistence import DocumentManager
from RevitServices.Transactions import TransactionManager

def TempIsolateElements(view, items):
	if not items: return False
	elif not isinstance(items, list): items = [items]
	ielements = List[ElementId]([x.Id for x in UnwrapElement(items)])
	try:
		UnwrapElement(view).IsolateElementsTemporary(ielements)
		return True
	except: return False

doc = DocumentManager.Instance.CurrentDBDocument

TransactionManager.Instance.EnsureInTransaction(doc)
if isinstance(IN[1], list):
	if isinstance(IN[0], list): OUT = [TempIsolateElements(x, y) for x, y in zip(IN[1], IN[0])]
	else: OUT = [TempIsolateElements(x, IN[0]) for x in IN[1]]
else: OUT = TempIsolateElements(IN[1], IN[0])
TransactionManager.Instance.TransactionTaskDone()
# ----------------------------------------

watch = Watch(test_if_then)
code_block_7 = CodeBlock { [2, 2]; 2; }
