# Dynamo graph System color Filters_script.dyn (Dynamo 2.13.1.3887)
# packages: archi-lab.net 2019.2.1

# group: Get Existing Filters and Remove from View
element_types = ElementTypes("FilterElement")
code_block = CodeBlock { "System Color_"; }
current = Document.Current()
activeView = Document.ActiveView(document=current)

# group: Get Piping Systems in Project
element_types_2 = ElementTypes("PipingSystemType")
all_elements_of_type = ElementsOfType(element_type=element_types_2)
code_block_2 = CodeBlock { "Abbreviation"; }
getParameterValueByName = Element.GetParameterValueByName(element=all_elements_of_type, parameterName=code_block_2)
length = String.Length(string=getParameterValueByName)
code_block_3 = CodeBlock(len=length) { len>0; }
filterByBoolMask = List.FilterByBoolMask(list=all_elements_of_type, mask=code_block_3)
name = Family.Name(family=filterByBoolMask.in)

# group: Group and Sort
code_block_4 = CodeBlock(list=name, list2=name) { DSCore.List.Flatten(list,1); DSCore.List.Flatten(list2,1); }
groupByKey = List.GroupByKey(list=code_block_4.out0, keys=code_block_4.out1)
string_from_object = FromObject(obj=groupByKey.uniqueKeys)
count = List.Count(list=string_from_object)

# group: Create Names
code_block_5 = CodeBlock(b=string_from_object) { Out="System Color_"+b; }

# group: Filter Categories
code_block_6 = CodeBlock(amount=count) { DSCore.List.OfRepeatedItem(Category.ByName("Pipes"),amount); }

# group: Filter Parameter
code_block_7 = CodeBlock { Category.ByName("Pipes"); "System Type"; }
all_elements_of_category = ElementsOfCategory(Category=code_block_7.out0)
parameterByName = Parameter.ParameterByName(element=all_elements_of_category, name=code_block_7.out1)
code_block_8 = CodeBlock(In=parameterByName) { In[0]; }
ofRepeatedItem = List.OfRepeatedItem(item=code_block_8, amount=count)

# group: Filter Rule
code_block_9 = CodeBlock(x=count) { DSCore.List.OfRepeatedItem("Equals",x); }
byRuleType = Revit.Filter.FilterRule.ByRuleType(type=code_block_9, value=string_from_object, parameter=ofRepeatedItem, lacing=Longest)

# group: Create Filter
byRules = Revit.Filter.ParameterFilterElement.ByRules(name=code_block_5, categories=code_block_6, rules=byRuleType, lacing=Longest)

code_block_10 = CodeBlock(pass=element_types, waitfor=byRules) { pass; waitfor; waitfor2; }  # unwired: waitfor2

# group (continued): Get Existing Filters and Remove from View
all_elements_of_type_2 = ElementsOfType(element_type=code_block_10.pass)
name_2 = Element.Name(element=all_elements_of_type_2)
contains = String.Contains(string=name_2, searchFor=code_block)
filterByBoolMask_2 = List.FilterByBoolMask(list=all_elements_of_type_2, mask=contains)
removeFilter = archilab.Revit.Views.Views.RemoveFilter(view=activeView, viewFilter=filterByBoolMask_2.in)

# group: Sort Filters
code_block_11 = CodeBlock(pass=filterByBoolMask_2.in, waitfor=removeFilter) { pass; waitfor; }
name_3 = Element.Name(element=code_block_11.pass)
sortByKey = List.SortByKey(list=code_block_11.pass, keys=name_3)

# group: Add Filters to View
current_2 = Document.Current()
activeView_2 = Document.ActiveView(document=current_2)
addFilter = View.AddFilter(view=activeView_2, parameterFilter=sortByKey.sortedList)

# group: Get System Line Colors & Sort
red = Python(IN[0]=filterByBoolMask.in)  # CPython3
# ---------- red.python (16 lines) ----------
# Load the Python Standard and DesignScript Libraries
import clr
clr.AddReference('ProtoGeometry')
from Autodesk.DesignScript.Geometry import *

# The inputs to this node will be stored as a list in the IN variables.
systemtype = UnwrapElement(IN[0])
listout = []

# Place your code below this line

for x in systemtype:
	listout.append(x.LineColor.Red)
	
# Assign your output to the OUT variable.
OUT = listout
# ----------------------------------------
sortByKey_2 = List.SortByKey(list=red, keys=name)
green = Python(IN[0]=filterByBoolMask.in)  # CPython3
# ---------- green.python (16 lines) ----------
# Load the Python Standard and DesignScript Libraries
import clr
clr.AddReference('ProtoGeometry')
from Autodesk.DesignScript.Geometry import *

# The inputs to this node will be stored as a list in the IN variables.
systemtype = UnwrapElement(IN[0])
listout = []

# Place your code below this line

for x in systemtype:
	listout.append(x.LineColor.Green)
	
# Assign your output to the OUT variable.
OUT = listout
# ----------------------------------------
sortByKey_3 = List.SortByKey(list=green, keys=name)
blue = Python(IN[0]=filterByBoolMask.in)  # CPython3
# ---------- blue.python (16 lines) ----------
# Load the Python Standard and DesignScript Libraries
import clr
clr.AddReference('ProtoGeometry')
from Autodesk.DesignScript.Geometry import *

# The inputs to this node will be stored as a list in the IN variables.
systemtype = UnwrapElement(IN[0])
listout = []

# Place your code below this line

for x in systemtype:
	listout.append(x.LineColor.Blue)
	
# Assign your output to the OUT variable.
OUT = listout
# ----------------------------------------
sortByKey_4 = List.SortByKey(list=blue, keys=name)

code_block_12 = CodeBlock(red=sortByKey_2.sortedList, green=sortByKey_3.sortedList, blue=sortByKey_4.sortedList) { Color.ByARGB(255,red,green,blue); }

# group: Apply Overrides
firstItem = List.FirstItem(list=addFilter)
color_palette = ColorPalette({R: 0, G: 0, B: 0, A: 255})
fill_patterns = FillPatterns("<Solid fill>")
byProperties = Revit.Filter.OverrideGraphicSettings.ByProperties(projectionFillColor=code_block_12, cutLineColor=color_palette, projectionLineColor=color_palette, projectionFillPattern=fill_patterns)
boolean = BoolSelector(true)
setFilterOverrides = View.SetFilterOverrides(view=firstItem, parameterFilter=sortByKey.sortedList, overrides=byProperties, hide=boolean)
